# Grasshopper definition DDU_CSC_GrasshopperInterface_Example_04.gh (Grasshopper 1.0.8)

# ---- group: __DDU_CSC_EXAMPLE_04__
# __DEVELOPMENT_CREDITS__: Authors: Max Benjamin Eschenbach
# 
# Digital Design Unit (DDU)
# Prof. Dr.-Ing. Oliver Tessmann
# Fachbereich Architektur
# Technical University of Darmstadt
# 
# CREDITS:
# ------------
# Please see: https://ddu.uber.space/credits
# Example 04:
# - Fetching all components of a certain type
# - Filter the already fetched components by dimensions
# Step 1
# comments & notes: Create new Session and sign in
# 
# (Add the CSC_Session component, connect the wires and add your credentials!)
ddu_csc_username = Panel("")
disablecache = BooleanToggle(False)
clearcache = Button()
refresh = Button()
image = ImageSampler(Filter="Colour", Interpolate=False, Umax=1, Umin=0, Vmax=1, Vmin=0, Wrap=1)

# comments & notes: Fetch a subset of components from the database using filters. Here we are fetching the 'spa_example_data' dataset.
# 
# NOTE: ReservedStatus = -1 means we ignore reservations entirely
# Step 2
fragment = ValueList({"Any": , "Only fragments": True, "Only non-fragmnents": False}, selected="Any")
maxdimensiony = Slider(0, range=0..2000)
mindimensionx = Slider(0, range=-0.1..2000)
maxdimensionx = Slider(0, range=0..2000)
maxdimensionz = Slider(0, range=0..500)
mindimensionz = Slider(0, range=0..500)
mindimensiony = Slider(0, range=0..2000)
reservedstatus = Slider(-1, range=-1..1)
complexity = ValueList({"Any complexity": , "0", "1", "2", "3"}, selected="Any complexity")
dataset = Panel("")
material = ValueList({"Any material": , "corian", "concrete", "timber", "aluminium", "steel"}, selected="Any material")
type = ValueList({"All types": , "sheet", "rubble", "beam", "column", "profile"}, selected="sheet")
fetchfilteredcomponents = FetchFilteredComponents(
    Type=type,
    Material=material,
    Dataset=dataset,
    Complexity=complexity,
    Fragment=fragment,
    MinDimensionX=mindimensionx,
    MaxDimensionX=maxdimensionx,
    MinDimensionY=mindimensiony,
    MaxDimensionY=maxdimensiony,
    MinDimensionZ=mindimensionz,
    MaxDimensionZ=maxdimensionz,
    ReservedStatus=reservedstatus)  # -> FilterDescription, ComponentData; inputs Type: String, Material: String, Dataset: String, Complexity: Int32, Fragment: Boolean, MinDimensionX: Double, MaxDimensionX: Double, MinDimensionY: Double, MaxDimensionY: Double, MinDimensionZ: Double, MaxDimensionZ: Double
# ---------- fetchfilteredcomponents: Python ----------
# -*- coding: utf-8 -*-
#! python3
# venv: DDU_CSC
print('ENV OK!')
# r: charset_normalizer
# r: requests
# r: numpy
# r: scipy
# r: scikit-learn
# r: robust-laplacian
# r: potpourri3d

# PYTHON STANDARD LIBRARY IMPORTS ---------------------------------------------
import json

# THIRD PARTY LIBRARY IMPORTS -------------------------------------------------
import requests

# RHINO AND GH RELATED IMPORTS ------------------------------------------------
import System  # type: ignore[reportMissingImport] # NOQA
import Grasshopper  # type: ignore[reportMissingImport] # NOQA
import Rhino  # type: ignore[reportMissingImport] # NOQA
import scriptcontext as sc  # type: ignore[reportMissingImport] # NOQA

# GHENV COMPONENT SETTINGS ----------------------------------------------------
ghenv.Component.Name = 'FetchFilteredComponents'  # type: ignore[reportUnedfinedVariable] # NOQA
ghenv.Component.NickName = 'FetchFilteredComponents'  # type: ignore[reportUnedfinedVariable] # NOQA
ghenv.Component.Category = 'DDU_CSC'  # type: ignore[reportUnedfinedVariable] # NOQA
ghenv.Component.SubCategory = '2 Catalogue Interface'  # type: ignore[reportUnedfinedVariable] # NOQA
ghenv.Component.Description = (  # type: ignore[reportUnedfinedVariable] # NOQA
    'Fetches components from the remote catalogue based on filter criteria '
    '(type, material, dataset, complexity, dimensions, reservation status). '
    'Builds query parameters and returns filtered results.'
)


class CSC_FetchFilteredComponents(Grasshopper.Kernel.GH_ScriptInstance):
    """
    Author: Max Benjamin Eschenbach
    License: MIT License
    Version: 251027
    """

    def __init__(self):
        """Initialize this component and set component parameters."""
        super().__init__()
        # initialize props
        self.Component = ghenv.Component  # type: ignore[reportUnedfinedVariable] # NOQA
        self.InputParams = self.Component.Params.Input
        self.OutputParams = self.Component.Params.Output

    def _addRemark(self, msg: str = ''):
        """Add a remark message to the component."""
        rml = self.Component.RuntimeMessageLevel.Remark
        self.AddRuntimeMessage(rml, msg)

    def _addWarning(self, msg: str = ''):
        """Add a warning message to the component."""
        rml = self.Component.RuntimeMessageLevel.Warning
        self.AddRuntimeMessage(rml, msg)

    def _addError(self, msg: str = ''):
        """Add an error message to the component."""
        rml = self.Component.RuntimeMessageLevel.Error
        self.AddRuntimeMessage(rml, msg)
    
    def BeforeRunScript(self):
        """Perform some setup actions."""
        # Initialize input param descriptions
        self.InputParams[0].Description = (
            'Component type filter (e.g., "beam", "slab", "column")'
        )
        self.InputParams[1].Description = (
            'Material type filter (e.g., "concrete", "steel", "wood")'
        )
        self.InputParams[2].Description = (
            'Dataset name filter (e.g., "sas_cita_scans", '
            '"mineral_composite_sheets")'
        )
        self.InputParams[3].Description = (
            'Complexity level filter (0-3, where 0=simple, 3=complex)'
        )
        self.InputParams[4].Description = (
            'Fragment status filter (True for fragments, False for complete)'
        )
        self.InputParams[5].Description = (
            'Minimum X dimension filter (bounding box)'
        )
        self.InputParams[6].Description = (
            'Maximum X dimension filter (bounding box)'
        )
        self.InputParams[7].Description = (
            'Minimum Y dimension filter (bounding box)'
        )
        self.InputParams[8].Description = (
            'Maximum Y dimension filter (bounding box)'
        )
        self.InputParams[9].Description = (
            'Minimum Z dimension filter (bounding box)'
        )
        self.InputParams[10].Description = (
            'Maximum Z dimension filter (bounding box)'
        )
        self.InputParams[11].Description = (
            'Reservation status filter: -1=ignore, 0=not reserved, '
            '1=reserved by current user'
        )
        # Initialize output param descriptions
        i = 0
        if self.OutputParams[0].Name == 'out':
            i += 1
        self.OutputParams[0+i].Description = (
            'Human-readable description of the applied filters and query'
        )
        self.OutputParams[1+i].Description = (
            'The ComponentData that was fetched from the server as JSON. '
            'Use \'DisassembleComponent\' to access the individual fields '
            'ready for Grasshopper')

    def get_auth_core_from_sticky(self):
        """Get AuthCore instance from sticky storage."""
        auth_core = sc.sticky.get('CSC_AuthCore')
        if auth_core is None:
            msg = ('No authentication found. Please use CSC_SignIn component '
                   'first.')
            self._addError(msg)
            self.Component.Message = msg
            return None
        return auth_core

    def build_filter_query_params(
            self,
            Type,
            Material,
            Dataset,
            Complexity,
            Fragment,
            MinDimensionX,
            MaxDimensionX,
            MinDimensionY,
            MaxDimensionY,
            MinDimensionZ,
            MaxDimensionZ,
            ReservedStatus):
        """Build query parameters for filtering components."""
        params = {}

        # Add type filter if provided
        if Type and len(Type) > 0:
            # Take the first type if multiple are provided
            type_value = Type[0] if isinstance(Type, list) else str(Type)
            if type_value and type_value.strip():
                params['comptype'] = type_value.strip()

        # Add material filter if provided
        if Material and Material.strip():
            params['material'] = Material.strip()

        # Add dataset filter if provided
        if Dataset and Dataset.strip():
            params['dataset'] = Dataset.strip()

        # Add complexity filter if provided
        if Complexity is not None:
            params['complexity'] = Complexity

        # Add fragment filter if provided
        if Fragment is not None:
            params['fragment'] = Fragment

        # Add reservation status filter if provided
        if ReservedStatus is not None and ReservedStatus != -1:
            if ReservedStatus == 0:
                # Fetch components that are not reserved by anyone
                params['reserved'] = 'false'
            elif ReservedStatus == 1:
                # Fetch components reserved by current user
                params['reserved'] = 'true'

        # Add bounding box filters if provided
        if MinDimensionX is not None and MinDimensionX != 0.0:
            params['bbx_min_x'] = MinDimensionX
        if MaxDimensionX is not None and MaxDimensionX != 0.0:
            params['bbx_max_x'] = MaxDimensionX
        if MinDimensionY is not None and MinDimensionY != 0.0:
            params['bbx_min_y'] = MinDimensionY
        if MaxDimensionY is not None and MaxDimensionY != 0.0:
            params['bbx_max_y'] = MaxDimensionY
        if MinDimensionZ is not None and MinDimensionZ != 0.0:
            params['bbx_min_z'] = MinDimensionZ
        if MaxDimensionZ is not None and MaxDimensionZ != 0.0:
            params['bbx_max_z'] = MaxDimensionZ

        return params

    def generate_filter_description(self, filter_params: dict) -> str:
        """Generates a human-readable description of the applied filters."""
        description = []
        if filter_params.get('comptype'):
            description.append(f'\nType: {filter_params["comptype"]}')
        if filter_params.get('material'):
            description.append(f'\nMaterial: {filter_params["material"]}')
        if filter_params.get('dataset'):
            description.append(f'\nDataset: {filter_params["dataset"]}')
        if filter_params.get('complexity') is not None:
            description.append(f'\nComplexity: {filter_params["complexity"]}')
        if filter_params.get('fragment') is not None:
            description.append(f'\nFragment: {filter_params["fragment"]}')

        # Add reservation status filter description
        if filter_params.get('reserved') == 'false':
            description.append('\nReservation: Not reserved by anyone')
        elif filter_params.get('reserved') == 'true':
            description.append('\nReservation: Reserved by current user')

        # Handle bounding box filters with detailed information
        bbx_filters = []
        if filter_params.get('bbx_min_x') is not None:
            bbx_filters.append(f'\nX >= {filter_params["bbx_min_x"]:.2f}')
        if filter_params.get('bbx_max_x') is not None:
            bbx_filters.append(f'\nX <= {filter_params["bbx_max_x"]:.2f}')
        if filter_params.get('bbx_min_y') is not None:
            bbx_filters.append(f'\nY >= {filter_params["bbx_min_y"]:.2f}')
        if filter_params.get('bbx_max_y') is not None:
            bbx_filters.append(f'\nY <= {filter_params["bbx_max_y"]:.2f}')
        if filter_params.get('bbx_min_z') is not None:
            bbx_filters.append(f'\nZ >= {filter_params["bbx_min_z"]:.2f}')
        if filter_params.get('bbx_max_z') is not None:
            bbx_filters.append(f'\nZ <= {filter_params["bbx_max_z"]:.2f}')

        if bbx_filters:
            description.append(f'\nBounding Box: {", ".join(bbx_filters)}')

        return f'Applied filters: {", ".join(description)}'

    def RunScript(self,
            Type: str,
            Material: str,
            Dataset: str,
            Complexity: int,
            Fragment: bool,
            MinDimensionX: float,
            MaxDimensionX: float,
            MinDimensionY: float,
            MaxDimensionY: float,
            MinDimensionZ: float,
            MaxDimensionZ: float,
            ReservedStatus):

        # Get AuthCore instance from sticky storage
        auth_core = self.get_auth_core_from_sticky()
        if auth_core is None:
            return

        # Check if authentication is valid
        if not auth_core.is_valid():
            msg = ('Authentication expired. Please use CSC_SignIn '
                   'component to refresh.')
            self._addError(msg)
            self.Component.Message = msg
            return

        try:
            self.Component.Message = 'Building filter query...'

            # Build filter query parameters
            filter_params = self.build_filter_query_params(
                Type, Material, Dataset, Complexity, Fragment,
                MinDimensionX, MaxDimensionX, MinDimensionY,
                MaxDimensionY, MinDimensionZ, MaxDimensionZ,
                ReservedStatus
            )

            # Build the query string
            query_string = '&'.join([
                f'{k}={v}' for k, v in filter_params.items()
            ])
            endpoint = '/components'
            if query_string:
                endpoint += f'?{query_string}'

            # Generate human-readable filter description
            filter_description = self.generate_filter_description(
                filter_params
            )

            self.Component.Message = (
                'Fetching filtered components (with cache)...'
            )

            # Create cache key based on filter parameters
            cache_key = (f'filtered:{query_string}' if query_string
                         else 'filtered:all')
            # Make cached request to fetch filtered components
            response = auth_core.cached_get(endpoint, cache_key, filter_params)

            if response.status_code == 200:
                # Successfully fetched components
                json_comps = response.json()
                component_count = len(json_comps)

                # Show filter info in message
                filter_msg = f'Found {component_count} components (cached).'

                self.Component.Message = filter_msg
                self._addRemark(
                    f'Successfully fetched {component_count} components '
                    f'with applied filters'
                )

                # Set up output trees and results tuple
                FilterDescription = Grasshopper.DataTree[System.Object]()
                ComponentData = Grasshopper.DataTree[System.Object]()
                __Results = (FilterDescription, ComponentData)

                # Loop over all components and add them to the data tree
                for i, json_comp in enumerate(json_comps):
                    # Create datatree path
                    ghp = Grasshopper.Kernel.Data.GH_Path(0, i)
                    # Add component data to the datatree
                    ComponentData.Add(json.dumps(json_comp), ghp)

                # Add filter description to the filter query output
                FilterDescription.Add(
                    filter_description,
                    Grasshopper.Kernel.Data.GH_Path(0)
                )

                return __Results

            elif response.status_code == 401:
                msg = 'Authentication failed. Please sign in again.'
                self._addError(msg)
                self.Component.Message = msg

            elif response.status_code == 403:
                msg = 'Access denied. Insufficient permissions.'
                self._addError(msg)
                self.Component.Message = msg

            elif response.status_code == 500:
                msg = 'Server error. Please try again later.'
                self._addWarning(msg)
                self.Component.Message = msg

            else:
                msg = (f'Request failed with status code: '
                       f'{response.status_code}')
                self._addError(msg)
                self.Component.Message = msg

        except requests.exceptions.ConnectionError as e:
            msg = 'Cannot connect to server. Please check your connection.'
            self._addError(msg + f'\nFull Error: {str(e)}')
            self.Component.Message = msg

        except requests.exceptions.Timeout as e:
            msg = 'Request timeout. Server may be slow.'
            self._addError(msg + f'\nFull Error: {str(e)}')
            self.Component.Message = msg

        except requests.exceptions.RequestException as e:
            msg = f'Request error: {str(e)}'
            self._addError(msg)
            self.Component.Message = msg

        except Exception as e:
            msg = f'Unexpected error: {str(e)}'
            self._addError(msg)
            self.Component.Message = msg

        # Return empty results if there was an error
        ComponentData = Grasshopper.DataTree[System.Object]()
        FilterDescription = Grasshopper.DataTree[System.Object]()
        __Results = (FilterDescription, ComponentData)
        return __Results
# ---------- end fetchfilteredcomponents ----------
panel = Panel(fetchfilteredcomponents.FilterDescription)
componentdata = Data(fetchfilteredcomponents.ComponentData)

# comments & notes: Filter Components that were already fetched from the Catalogue.
# 
# In this case:
# - Only sheets with X maximum of 500.0 and Y between 200.0 and 300.0
# Step 3
fragment_2 = ValueList({"Any": , "Only fragments": True, "Only non-fragmnents": False}, selected="Any")
maxdimensiony_2 = Slider(300, range=0..2000)
mindimensionx_2 = Slider(0, range=-0.1..2000)
maxdimensionx_2 = Slider(500, range=0..2000)
maxdimensionz_2 = Slider(0, range=0..500)
mindimensionz_2 = Slider(0, range=0..500)
mindimensiony_2 = Slider(200, range=0..2000)
complexity_2 = ValueList({"Any complexity": , "0", "1", "2", "3"}, selected="Any complexity")
dataset_2 = Panel("")
material_2 = ValueList({"Any material": , "corian", "concrete", "timber", "aluminium", "steel"}, selected="Any material")
type_2 = ValueList({"All types": , "sheet", "rubble", "beam", "column", "profile"}, selected="All types")
componentdata_2 = Data(componentdata)
filtercomponents = FilterComponents(
    Type=type_2,
    Material=material_2,
    Dataset=dataset_2,
    Complexity=complexity_2,
    Fragment=fragment_2,
    MinDimensionX=mindimensionx_2,
    MaxDimensionX=maxdimensionx_2,
    MinDimensionY=mindimensiony_2,
    MaxDimensionY=maxdimensiony_2,
    MinDimensionZ=mindimensionz_2,
    MaxDimensionZ=maxdimensionz_2,
    ComponentData=componentdata_2)  # -> FilterDescription, ComponentData; inputs Type: String, Material: String, Dataset: String, Complexity: Int32, Fragment: Boolean, MinDimensionX: Double, MaxDimensionX: Double, MinDimensionY: Double, MaxDimensionY: Double, MinDimensionZ: Double, MaxDimensionZ: Double, ComponentData: tree of String
# ---------- filtercomponents: Python ----------
# -*- coding: utf-8 -*-
#! python3
# venv: DDU_CSC
print('ENV OK!')
# r: charset_normalizer
# r: requests
# r: numpy
# r: scipy
# r: scikit-learn
# r: robust-laplacian
# r: potpourri3d

# PYTHON STANDARD LIBRARY IMPORTS ---------------------------------------------
import json

# RHINO AND GH RELATED IMPORTS ------------------------------------------------
import System  # type: ignore[reportMissingImport] # NOQA
import Grasshopper  # type: ignore[reportMissingImport] # NOQA
import Rhino  # type: ignore[reportMissingImport] # NOQA

# GHENV COMPONENT SETTINGS ----------------------------------------------------
ghenv.Component.Name = 'FilterComponents'  # type: ignore[reportUnedfinedVariable] # NOQA
ghenv.Component.NickName = 'FilterComponents'  # type: ignore[reportUnedfinedVariable] # NOQA
ghenv.Component.Category = 'DDU_CSC'  # type: ignore[reportUnedfinedVariable] # NOQA
ghenv.Component.SubCategory = '2 Catalogue Interface'  # type: ignore[reportUnedfinedVariable] # NOQA
ghenv.Component.Description = (  # type: ignore[reportUnedfinedVariable] # NOQA
    'Filters a list of component data based on various criteria (type, '
    'material, dataset, complexity, fragment, bounding box dimensions). '
    'Works with local component data.'
)


class CSC_FilterComponents(Grasshopper.Kernel.GH_ScriptInstance):
    """
    Author: Max Benjamin Eschenbach
    License: MIT License
    Version: 251027
    """

    def __init__(self):
        """Initialize this component and set component parameters."""
        super().__init__()
        # initialize props
        self.Component = ghenv.Component  # type: ignore[reportUnedfinedVariable] # NOQA
        self.InputParams = self.Component.Params.Input
        self.OutputParams = self.Component.Params.Output

    def _addRemark(self, msg: str = ''):
        """Add a remark message to the component."""
        rml = self.Component.RuntimeMessageLevel.Remark
        self.AddRuntimeMessage(rml, msg)

    def _addWarning(self, msg: str = ''):
        """Add a warning message to the component."""
        rml = self.Component.RuntimeMessageLevel.Warning
        self.AddRuntimeMessage(rml, msg)

    def _addError(self, msg: str = ''):
        """Add an error message to the component."""
        rml = self.Component.RuntimeMessageLevel.Error
        self.AddRuntimeMessage(rml, msg)
    
    def BeforeRunScript(self):
        """Perform some setup actions."""
        # Initialize input param descriptions
        self.InputParams[0].Description = (
            'Component type filter (e.g., "beam", "slab", "column")'
        )
        self.InputParams[1].Description = (
            'Material type filter (e.g., "concrete", "steel", "wood")'
        )
        self.InputParams[2].Description = (
            'Dataset name filter (e.g., "sas_cita_scans", '
            '"mineral_composite_sheets")'
        )
        self.InputParams[3].Description = (
            'Complexity level filter (0-3, where 0=simple, 3=complex)'
        )
        self.InputParams[4].Description = (
            'Fragment status filter (True for fragments, False for complete)'
        )
        self.InputParams[5].Description = (
            'Minimum X dimension filter (bounding box)'
        )
        self.InputParams[6].Description = (
            'Maximum X dimension filter (bounding box)'
        )
        self.InputParams[7].Description = (
            'Minimum Y dimension filter (bounding box)'
        )
        self.InputParams[8].Description = (
            'Maximum Y dimension filter (bounding box)'
        )
        self.InputParams[9].Description = (
            'Minimum Z dimension filter (bounding box)'
        )
        self.InputParams[10].Description = (
            'Maximum Z dimension filter (bounding box)'
        )
        self.InputParams[11].Description = (
            'Component data to filter (from FetchComponents or similar)'
        )
        # Initialize output param descriptions
        i = 0
        if self.OutputParams[0].Name == 'out':
            i += 1
        self.OutputParams[0+i].Description = (
            'Human-readable description of the applied filters'
        )
        self.OutputParams[1+i].Description = (
            'Filtered ComponentData as JSON strings. Use '
            '\'DisassembleComponent\' to access the individual fields '
            'ready for Grasshopper'
        )

    def apply_filters(self, component_data: dict, filter_params: dict) -> bool:
        """
        Apply all filters to a single component and return True if it passes.
        """

        # Type filter
        if filter_params.get('type') and filter_params['type'].strip():
            if (component_data.get('type', '').lower() !=
                    filter_params['type'].lower()):
                return False

        # Material filter
        if filter_params.get('material') and filter_params['material'].strip():
            if (component_data.get('material', '').lower() !=
                    filter_params['material'].lower()):
                return False

        # Dataset filter
        if filter_params.get('dataset') and filter_params['dataset'].strip():
            if (component_data.get('dataset', '').lower() !=
                    filter_params['dataset'].lower()):
                return False

        # Complexity filter
        if filter_params.get('complexity') is not None:
            if component_data.get('complexity') != filter_params['complexity']:
                return False

        # Fragment filter
        if filter_params.get('fragment') is not None:
            if component_data.get('fragment') != filter_params['fragment']:
                return False

        # Bounding box filters
        # Note: bbx is stored as [X, Y, Z] where X, Y, Z are dimensions
        bbx = component_data.get('bbx')
        if (bbx and isinstance(bbx, list) and len(bbx) >= 3):
            bbx_x = bbx[0]
            bbx_y = bbx[1]
            bbx_z = bbx[2]

            # X dimension filters
            if filter_params.get('min_x') is not None:
                if bbx_x < filter_params['min_x']:
                    return False
            if filter_params.get('max_x') is not None:
                if bbx_x > filter_params['max_x']:
                    return False

            # Y dimension filters
            if filter_params.get('min_y') is not None:
                if bbx_y < filter_params['min_y']:
                    return False
            if filter_params.get('max_y') is not None:
                if bbx_y > filter_params['max_y']:
                    return False

            # Z dimension filters
            if filter_params.get('min_z') is not None:
                if bbx_z < filter_params['min_z']:
                    return False
            if filter_params.get('max_z') is not None:
                if bbx_z > filter_params['max_z']:
                    return False

        return True

    def generate_filter_description(self, filter_params: dict) -> str:
        """Generates a human-readable description of the applied filters."""
        description = []
        if filter_params.get('type'):
            description.append(f'\nType: {filter_params["type"]}')
        if filter_params.get('material'):
            description.append(f'\nMaterial: {filter_params["material"]}')
        if filter_params.get('dataset'):
            description.append(f'\nDataset: {filter_params["dataset"]}')
        if filter_params.get('complexity') is not None:
            description.append(f'\nComplexity: {filter_params["complexity"]}')
        if filter_params.get('fragment') is not None:
            description.append(f'\nFragment: {filter_params["fragment"]}')

        # Handle bounding box filters with detailed information
        bbx_filters = []
        if filter_params.get('min_x') is not None:
            bbx_filters.append(f'\nX >= {filter_params["min_x"]:.2f}')
        if filter_params.get('max_x') is not None:
            bbx_filters.append(f'\nX <= {filter_params["max_x"]:.2f}')
        if filter_params.get('min_y') is not None:
            bbx_filters.append(f'\nY >= {filter_params["min_y"]:.2f}')
        if filter_params.get('max_y') is not None:
            bbx_filters.append(f'\nY <= {filter_params["max_y"]:.2f}')
        if filter_params.get('min_z') is not None:
            bbx_filters.append(f'\nZ >= {filter_params["min_z"]:.2f}')
        if filter_params.get('max_z') is not None:
            bbx_filters.append(f'\nZ <= {filter_params["max_z"]:.2f}')

        if bbx_filters:
            description.append(f'\nBounding Box: {", ".join(bbx_filters)}')

        return f'Applied filters: {", ".join(description)}'

    def RunScript(self,
            Type: str,
            Material: str,
            Dataset: str,
            Complexity: int,
            Fragment: bool,
            MinDimensionX: float,
            MaxDimensionX: float,
            MinDimensionY: float,
            MaxDimensionY: float,
            MinDimensionZ: float,
            MaxDimensionZ: float,
            ComponentData: Grasshopper.DataTree[str]):
        # Validate input data
        if not ComponentData or ComponentData.DataCount == 0:
            msg = ('No component data provided. '
                   'Please connect ComponentData input.')
            self._addWarning(msg)
            self.Component.Message = msg

            # Return empty results
            FilterDescription = Grasshopper.DataTree[System.Object]()
            FilteredComponentData = Grasshopper.DataTree[System.Object]()
            __Results = (FilterDescription, FilteredComponentData)
            return __Results

        try:
            self.Component.Message = 'Building filter parameters...'

            # Build filter parameters dictionary
            filter_params = {}

            # Add type filter if provided
            if Type and Type.strip() and Type.lower() != 'alltypes':
                filter_params['type'] = Type.strip()

            # Add material filter if provided
            if (Material and Material.strip() and
                    Material.lower() != 'allmaterials'):
                filter_params['material'] = Material.strip()

            # Add dataset filter if provided
            if (Dataset and Dataset.strip() and
                    Dataset.lower() != 'alldatasets'):
                filter_params['dataset'] = Dataset.strip()

            # Add complexity filter if provided
            if Complexity is not None:
                filter_params['complexity'] = Complexity

            # Add fragment filter if provided
            if Fragment is not None:
                filter_params['fragment'] = Fragment

            # Add bounding box filters if provided
            if MinDimensionX is not None and MinDimensionX != 0.0:
                filter_params['min_x'] = MinDimensionX
            if MaxDimensionX is not None and MaxDimensionX != 0.0:
                filter_params['max_x'] = MaxDimensionX
            if MinDimensionY is not None and MinDimensionY != 0.0:
                filter_params['min_y'] = MinDimensionY
            if MaxDimensionY is not None and MaxDimensionY != 0.0:
                filter_params['max_y'] = MaxDimensionY
            if MinDimensionZ is not None and MinDimensionZ != 0.0:
                filter_params['min_z'] = MinDimensionZ
            if MaxDimensionZ is not None and MaxDimensionZ != 0.0:
                filter_params['max_z'] = MaxDimensionZ

            # Generate human-readable filter description
            filter_description = self.generate_filter_description(
                filter_params
            )

            self.Component.Message = 'Filtering components...'

            # Set up output trees and results tuple
            FilterDescription = Grasshopper.DataTree[System.Object]()
            FilteredComponentData = Grasshopper.DataTree[System.Object]()
            __Results = (FilterDescription, FilteredComponentData)

            # Add filter description to the filter query output
            FilterDescription.Add(
                filter_description,
                Grasshopper.Kernel.Data.GH_Path(0))

            # Filter components
            filtered_count = 0
            total_count = 0

            # Loop over all branches
            for i in range(ComponentData.BranchCount):
                ghp = ComponentData.Paths[i]
                for j, comp in enumerate(ComponentData.Branches[i]):
                    total_count += 1
                    try:
                        # Load component data
                        component_data = json.loads(comp)

                        # Apply filters
                        if self.apply_filters(component_data, filter_params):
                            # Component passes all filters, add to output
                            FilteredComponentData.Add(comp, ghp)
                            filtered_count += 1

                    except json.JSONDecodeError as e:
                        msg = f'Failed to parse component data: {str(e)}'
                        self._addWarning(msg)
                        continue
                    except Exception as e:
                        msg = f'Error processing component: {str(e)}'
                        self._addWarning(msg)
                        continue

            # Update component message
            if filtered_count == 0:
                msg = 'No components match the applied filters.'
                self.Component.Message = msg
                self._addWarning(msg)
            else:
                msg = f'Filtered {filtered_count} of {total_count} components.'
                self.Component.Message = msg
                self._addRemark(
                    f'Successfully filtered {filtered_count} components '
                    f'from {total_count} total components'
                )

            return __Results

        except Exception as e:
            msg = f'Unexpected error during filtering: {str(e)}'
            self._addError(msg)
            self.Component.Message = msg

            # Return empty results if there was an error
            FilterDescription = Grasshopper.DataTree[System.Object]()
            FilteredComponentData = Grasshopper.DataTree[System.Object]()
            __Results = (FilterDescription, FilteredComponentData)
            return __Results
# ---------- end filtercomponents ----------
log = Panel(filtercomponents.FilterDescription)
componentdata_3 = Data(filtercomponents.ComponentData)
