# Grasshopper definition DDU_CSC_GrasshopperInterface_Example_06.gh (Grasshopper 1.0.8)

# ---- group: __DDU_CSC_EXAMPLE_06__
# Step 2
# comments & notes: Create some Voronoi Cells that we will use as our target "Design Shapes".
# 
# You can play with the Random Seed to get different cell arrngements (randomized).
x_extents = Slider(2500, range=100..3000)
y_extents = Slider(1000, range=100..3000)
dom = ConstructDomain(DomainStart="0", DomainEnd=x_extents)
dom_2 = ConstructDomain(DomainStart="0", DomainEnd=y_extents)
cellcount = Slider(16, range=10..1000)
randomseed = Slider(2637, range=0..10000)
rectangle = Rectangle(Plane=PlaneXY(0, 0, 0), XSize=dom, YSize=dom_2, Radius=0)  # -> Rectangle, Length
boundary = BoundarySurfaces(Edges=rectangle.Rectangle)
popgeo = PopulateGeometry(Geometry=boundary, Count=cellcount, Seed=randomseed)
voronoi = Voronoi(Points=popgeo, BruteForceOverride=False)
rint = RegionIntersection(CurvesA=voronoi, CurvesB=graft(rectangle.Rectangle))  # -> flatten(Result)
curvepreviewlw = CurvePreviewLW(Curves=flatten(rint), Thickness="2")  # inputs Curves: list of Curve, Colors: list of Color, Thickness: list of Int32
# ---------- curvepreviewlw: C# ----------
#region Usings
using System;
using System.Linq;
using System.Collections;
using System.Collections.Generic;
using System.Drawing;

using Rhino;
using Rhino.Geometry;

using Grasshopper;
using Grasshopper.Kernel;
using Grasshopper.Kernel.Data;
using Grasshopper.Kernel.Types;
#endregion

public class Script_Instance : GH_ScriptInstance
{
    #region Notes
    /* 
      Members:
        RhinoDoc RhinoDocument
        GH_Document GrasshopperDocument
        IGH_Component Component
        int Iteration

      Methods (Virtual & overridable):
        Print(string text)
        Print(string format, params object[] args)
        Reflect(object obj)
        Reflect(object obj, string method_name)

        Author: Max Benjamin Eschenbach
        License: MIT License
        Version: 251022
    */
    #endregion

    List<Curve> drawCurves;
    List<Color> drawColors;
    List<int> drawThickness;

    private void RunScript(
		List<Curve> Curves,
		List<Color> Colors,
		List<int> Thickness)
    {
        // set component params
        this.Component.Name = "CurvePreviewLW";
        this.Component.NickName = "CurvePreviewLW";
        this.Component.Category = "DDU_CSC";
        this.Component.SubCategory = "8 Visualisation";
        this.Component.Description = (
            "Render curves with custom LineWeights."
        );

        this.drawCurves = new List<Curve>();   
        this.drawColors = new List<Color>();
        this.drawThickness = new List<int>();

        if (Curves == null) return;
        if (Colors == null) this.drawColors = new List<Color>{Color.Black};
        else this.drawColors = Colors;

        if (Thickness == null) this.drawThickness = new List<int>{1};
        else this.drawThickness = Thickness;

        for (int i = 0; i < Curves.Count; i++)
        {
            if (Curves[i] != null)
            {
                this.drawCurves.Add(Curves[i]);
            }
            else
            {
                continue;
            }
            if (Colors == null || i >= Colors.Count || Colors[i] == null)
            {
                this.drawColors.Add(drawColors.Last());
            }
            else
            {
                this.drawColors.Add(Colors[i]);
            }
            if (Thickness == null || i >= Thickness.Count || Thickness[i] == null)
            {
                this.drawThickness.Add(drawThickness.Last());
            }
            else
            {
                this.drawThickness.Add(Thickness[i]);
            }
        }
    }

    override public void DrawViewportWires(IGH_PreviewArgs args)
    {
        if (this.drawCurves != null)
        {
            try
            {
                for (int i = 0; i < this.drawCurves.Count; i++)
                {
                    args.Display.DrawCurve(
                        this.drawCurves[i],
                        this.drawColors[i],
                        this.drawThickness[i]
                    );
                }
                
            }
            catch (Exception e)
            {
                this.AddRuntimeMessage(GH_RuntimeMessageLevel.Warning, "Error while drawing Preview!");
                this.Print(e.ToString());
            }
        }
        else
        {
            return;
        }
    }
}
# ---------- end curvepreviewlw ----------
designshapes = Data(rint)

# __DEVELOPMENT_CREDITS__: Authors: Max Benjamin Eschenbach
# Constributors: Alessandro Garruto
# 
# Digital Design Unit (DDU)
# Prof. Dr.-Ing. Oliver Tessmann
# Fachbereich Architektur
# Technical University of Darmstadt
# 
# CREDITS:
# ------------
# Please see: https://ddu.uber.space/credits
# Example 06:
# - Fetch all corian sheet components
# - Get radial signature descriptors
# - Create voronoi cells as an example "demand" of design shapes
# - Compute radial signature descriptors for design shapes
# - Match catalog to design shapes either with greedy or optimal assignment
# Step 1
# comments & notes: Create new User Session and sign in
# 
# (Add your credentials!)
ddu_csc_username = Panel("")
ddu_csc_password = Panel("")
disablecache = BooleanToggle(False)
clearcache = Button()
refresh = Button()
csc_session = Session(Username=ddu_csc_username, Password=ddu_csc_password, Refresh=refresh, DisableCache=disablecache, ClearCache=clearcache)  # -> Status; inputs Username: String, Password: String, Refresh: Boolean, DisableCache: Boolean, ClearCache: Boolean
# ---------- csc_session: Python ----------
#! python3
# -*- coding: utf-8 -*-
# venv: DDU_CSC
print('ENV OK!')
# r: charset_normalizer
# r: requests
# r: numpy
# r: scipy
# r: scikit-learn
# r: robust-laplacian
# r: potpourri3d

# PYTHON STANDARD LIBRARY IMPORTS ---------------------------------------------
import time  # NOQA
import json  # NOQA
import base64  # NOQA
import os  # NOQA
import hashlib  # NOQA
import pickle  # NOQA
import math  # NOQA
from threading import RLock  # NOQA
import uuid  # NOQA
from datetime import datetime, timedelta  # NOQA

# THIRD PARTY LIBRARY IMPORTS -------------------------------------------------
import requests  # NOQA

# RHINO AND GH RELATED IMPORTS ------------------------------------------------
import System  # NOQA
import Rhino  # NOQA
import Grasshopper  # NOQA
import scriptcontext as sc  # NOQA

# GHENV COMPONENT SETTINGS ----------------------------------------------------
ghenv.Component.Name = 'Session'  # NOQA
ghenv.Component.NickName = 'CSC_Session'  # NOQA
ghenv.Component.Category = 'DDU_CSC'  # NOQA
ghenv.Component.SubCategory = '1 User'  # NOQA
ghenv.Component.Description = (  # NOQA
    'Handles user authentication with the remote API, manages access '
    'tokens, and provides caching functionality for API responses and '
    'geometry. Stores authentication state in scriptcontext.sticky.'
)

"""
Author: Max Benjamin Eschenbach
License: MIT License
Version: 251203
"""


# ComponentCache - Embedded ---------------------------------------------------

class _ComponentCache(object):
    """
    Component cache manager for efficient local storage and retrieval.

    Author: Max Benjamin Eschenbach
    License: MIT License
    """

    def __init__(self, cache_dir=None, ttl_hours=24):
        self.ttl_hours = ttl_hours
        self.cache_dir = cache_dir or self._get_default_cache_dir()
        self.components_dir = os.path.join(self.cache_dir, 'components')
        self.designs_dir = os.path.join(self.cache_dir, 'designs')
        self.metadata_dir = os.path.join(self.cache_dir, 'metadata')
        self.geometry_dir = os.path.join(self.cache_dir, 'component_geometry')
        self._lock = RLock()

        # Ensure cache directories exist
        self._ensure_cache_dirs()

    def _get_default_cache_dir(self):
        """Get platform-specific cache directory."""
        if os.name == 'nt':  # Windows
            appdata = os.environ.get('APPDATA', '')
            return os.path.join(appdata, 'DDU_CSC', 'cache')
        else:  # macOS/Linux
            home = os.path.expanduser('~')
            return os.path.join(
                home, 'Library', 'Application Support', 'DDU_CSC', 'cache'
            )

    def _ensure_cache_dirs(self):
        """Create cache directories if they don't exist."""
        dirs = [
            self.cache_dir, self.components_dir, self.designs_dir,
            self.metadata_dir, self.geometry_dir
        ]
        for directory in dirs:
            if not os.path.exists(directory):
                os.makedirs(directory, exist_ok=True)

    def _get_cache_key_hash(self, cache_key):
        """Generate a safe filename from cache key."""
        return hashlib.md5(cache_key.encode('utf-8')).hexdigest()

    def _is_expired(self, timestamp_str):
        """Check if cache entry is expired based on TTL."""
        try:
            timestamp = datetime.fromisoformat(
                timestamp_str.replace('Z', '+00:00'))
            expiry = timestamp + timedelta(hours=self.ttl_hours)
            return datetime.now(timestamp.tzinfo) > expiry
        except (ValueError, TypeError):
            return True  # If we can't parse timestamp, consider expired

    def get(self, cache_key, filters=None):
        """
        Get cached data for a cache key.

        Args:
            cache_key: Cache key (e.g., 'all_components', 'component:uuid')
            filters: Optional filter parameters for metadata cache

        Returns:
            Tuple of (data, etag, is_from_cache) or
            (None, None, False) if not found
        """
        # Try binary cache first
        return self.get_binary(cache_key)

    def set(self, cache_key, data, etag=None, filters=None):
        """
        Store data in cache.

        Args:
            cache_key: Cache key
            data: Data to cache
            etag: ETag for the data
            filters: Optional filter parameters
        """
        # Use binary cache
        self.set_binary(cache_key, data, etag, filters)

    def invalidate(self, pattern=None):
        """
        Invalidate cache entries.

        Args:
            pattern: Optional pattern to match cache keys (None = clear all)
        """
        with self._lock:
            try:
                if pattern is None:
                    # Clear all cache
                    for directory in [
                            self.components_dir,
                            self.metadata_dir,
                            self.geometry_dir
                    ]:
                        if os.path.exists(directory):
                            for filename in os.listdir(directory):
                                file_path = os.path.join(directory, filename)
                                if os.path.isfile(file_path):
                                    os.remove(file_path)
                                elif os.path.isdir(file_path):
                                    # Remove subdirectories
                                    # (geometry type folders)
                                    import shutil
                                    shutil.rmtree(
                                        file_path,
                                        ignore_errors=True
                                    )
                else:
                    # Clear specific pattern
                    pattern_hash = self._get_cache_key_hash(pattern)
                    metadata_file = os.path.join(
                        self.metadata_dir, f"{pattern_hash}.json"
                    )
                    if os.path.exists(metadata_file):
                        os.remove(metadata_file)

            except (IOError, OSError):
                pass

    def get_cache_stats(self):
        """Get cache statistics."""
        with self._lock:
            try:
                component_count = len(
                    [f for f in os.listdir(self.components_dir)
                     if f.endswith('.pkl')]
                )
                metadata_count = len(
                    [f for f in os.listdir(self.metadata_dir)
                     if f.endswith('.json')]
                )

                # Calculate total cache size
                total_size = 0
                for directory in [self.components_dir, self.metadata_dir]:
                    for filename in os.listdir(directory):
                        file_path = os.path.join(directory, filename)
                        if os.path.isfile(file_path):
                            total_size += os.path.getsize(file_path)

                # Calculate geometry cache stats
                geometry_count = 0
                geometry_size = 0
                if os.path.exists(self.geometry_dir):
                    for root, dirs, files in os.walk(self.geometry_dir):
                        for file in files:
                            if file.endswith('.pkl'):
                                geometry_count += 1
                                file_path = os.path.join(root, file)
                                if os.path.isfile(file_path):
                                    geometry_size += os.path.getsize(file_path)

                # Calculate design cache stats
                design_count = 0
                design_size = 0
                if os.path.exists(self.designs_dir):
                    for filename in os.listdir(self.designs_dir):
                        if filename.endswith('.pkl'):
                            design_count += 1
                            file_path = os.path.join(
                                self.designs_dir, filename)
                            if os.path.isfile(file_path):
                                design_size += os.path.getsize(file_path)

                return {
                    'component_count': component_count,
                    'metadata_count': metadata_count,
                    'geometry_count': geometry_count,
                    'design_count': design_count,
                    'total_size_bytes': (total_size + geometry_size +
                                         design_size),
                    'geometry_size_bytes': geometry_size,
                    'design_size_bytes': design_size,
                    'cache_dir': self.cache_dir
                }
            except (IOError, OSError):
                return {
                    'component_count': 0,
                    'metadata_count': 0,
                    'geometry_count': 0,
                    'design_count': 0,
                    'total_size_bytes': 0,
                    'geometry_size_bytes': 0,
                    'design_size_bytes': 0,
                    'cache_dir': self.cache_dir
                }

    def get_geometry(self, component_id, geometry_type):
        """
        Get cached geometry for a component.

        Args:
            component_id: Component ID
            geometry_type: 'reduced' or 'detailed'

        Returns:
            Tuple of (geometry_data, etag, is_from_cache) or
            (None, None, False) if not found
        """
        # Try binary cache first
        return self.get_geometry_binary(component_id, geometry_type)

    def set_geometry(self, component_id, geometry_type, geometry_data, etag):
        """
        Cache geometry data for a component.

        Args:
            component_id: Component ID
            geometry_type: 'reduced' or 'detailed'
            geometry_data: OBJ file content as string
            etag: ETag from server response
        """
        # Convert OBJ string to Rhino meshes and store as binary
        try:
            meshes = self._convert_obj_to_meshes(geometry_data)
            if meshes:  # Only store if conversion succeeded
                self.set_geometry_binary(
                    component_id,
                    geometry_type,
                    meshes,
                    etag
                )
        except Exception as e:
            # Don't cache anything if conversion fails
            self._addError(
                f"Error converting OBJ to meshes: {str(e)}")

    def get_binary(self, cache_key):
        """
        Get cached data from binary cache.

        Args:
            cache_key: Cache key (e.g., 'component:uuid')

        Returns:
            Tuple of (data, etag, is_from_cache) or
            (None, None, False) if not found
        """
        with self._lock:
            try:
                # Check metadata cache first
                metadata_file = os.path.join(
                    self.metadata_dir,
                    f"{self._get_cache_key_hash(cache_key)}.json"
                )

                if not os.path.exists(metadata_file):
                    return None, None, False

                with open(metadata_file, 'r', encoding='utf-8') as f:
                    metadata = json.load(f)

                # Check if expired
                if self._is_expired(metadata.get('cached_at', '')):
                    return None, None, False

                # Handle different cache key types
                if cache_key.startswith('component:'):
                    # Individual component
                    component_id = cache_key.split(':', 1)[1]
                    component_file = os.path.join(
                        self.components_dir, f"{component_id}.pkl"
                    )

                    if os.path.exists(component_file):
                        with open(component_file, 'rb') as f:
                            component_data = pickle.load(f)
                        return component_data, metadata.get('etag'), True

                elif (cache_key == 'all_components' or
                        cache_key.startswith('filtered:')):
                    # Collection of components
                    components = []
                    for comp_ref in metadata.get('components', []):
                        comp_id = comp_ref.get('id')
                        if comp_id:
                            comp_file = os.path.join(
                                self.components_dir, f"{comp_id}.pkl"
                            )
                            if os.path.exists(comp_file):
                                with open(comp_file, 'rb') as f:
                                    components.append(pickle.load(f))

                    return components, metadata.get('etag'), True

                elif cache_key.startswith('design:'):
                    # Individual design
                    design_id = cache_key.split(':', 1)[1]
                    design_file = os.path.join(
                        self.designs_dir, f"{design_id}.pkl"
                    )

                    if os.path.exists(design_file):
                        with open(design_file, 'rb') as f:
                            design_data = pickle.load(f)
                        return design_data, metadata.get('etag'), True

                elif cache_key == 'schema:component':
                    # Schema data is stored directly in metadata
                    return metadata.get('data'), metadata.get('etag'), True

                elif cache_key == 'schema:design':
                    # Schema data is stored directly in metadata
                    return metadata.get('data'), metadata.get('etag'), True

                return None, None, False

            except (IOError, pickle.PickleError, KeyError):
                return None, None, False

    def set_binary(self, cache_key, data, etag=None, filters=None):
        """
        Store data in binary cache.

        Args:
            cache_key: Cache key
            data: Data to cache
            etag: ETag for the data
            filters: Optional filter parameters
        """
        with self._lock:
            try:
                current_time = datetime.now().isoformat()

                if cache_key.startswith('component:'):
                    # Individual component
                    component_id = cache_key.split(':', 1)[1]
                    component_file = os.path.join(
                        self.components_dir, f"{component_id}.pkl"
                    )

                    # Store component data as pickle
                    with open(component_file, 'wb') as f:
                        pickle.dump(data, f)

                    # Store metadata
                    metadata = {
                        'cache_key': cache_key,
                        'cached_at': current_time,
                        'etag': etag,
                        'type': 'component'
                    }

                elif (cache_key == 'all_components' or
                        cache_key.startswith('filtered:')):
                    # Collection of components
                    components = []
                    for component in data:
                        comp_id = component.get('_id') or component.get('id')
                        if comp_id:
                            # Store individual component as pickle
                            comp_file = os.path.join(
                                self.components_dir, f"{comp_id}.pkl"
                            )
                            with open(comp_file, 'wb') as f:
                                pickle.dump(component, f)

                            # Add reference to metadata
                            components.append({
                                'id': comp_id,
                                'etag': component.get('etag'),
                                'lastmodified': component.get('lastmodified')
                            })

                    # Store metadata
                    metadata = {
                        'cache_key': cache_key,
                        'cached_at': current_time,
                        'etag': etag,
                        'type': 'collection',
                        'components': components,
                        'filters': filters
                    }

                elif cache_key.startswith('design:'):
                    # Individual design
                    design_id = cache_key.split(':', 1)[1]
                    design_file = os.path.join(
                        self.designs_dir, f"{design_id}.pkl"
                    )

                    # Store design data as pickle
                    with open(design_file, 'wb') as f:
                        pickle.dump(data, f)

                    # Store metadata
                    metadata = {
                        'cache_key': cache_key,
                        'cached_at': current_time,
                        'etag': etag,
                        'type': 'design'
                    }

                elif cache_key == 'schema:component':
                    # Schema data - store directly in metadata
                    metadata = {
                        'cache_key': cache_key,
                        'cached_at': current_time,
                        'etag': etag,
                        'type': 'schema',
                        'data': data
                    }

                elif cache_key == 'schema:design':
                    # Schema data - store directly in metadata
                    metadata = {
                        'cache_key': cache_key,
                        'cached_at': current_time,
                        'etag': etag,
                        'type': 'schema',
                        'data': data
                    }

                # Write metadata file
                metadata_file = os.path.join(
                    self.metadata_dir,
                    f"{self._get_cache_key_hash(cache_key)}.json"
                )
                with open(metadata_file, 'w', encoding='utf-8') as f:
                    json.dump(metadata, f, indent=2, ensure_ascii=False)

            except (IOError, pickle.PickleError, KeyError):
                # Silently fail cache writes to not break main functionality
                pass

    def get_geometry_binary(self, component_id, geometry_type):
        """
        Get cached geometry from binary cache.

        Args:
            component_id: Component ID
            geometry_type: 'reduced' or 'detailed'

        Returns:
            Tuple of (meshes, etag, is_from_cache) or
            (None, None, False) if not found
        """
        with self._lock:
            try:
                cache_key = f'geometry:{geometry_type}:{component_id}'
                metadata_file = os.path.join(
                    self.metadata_dir,
                    f"{self._get_cache_key_hash(cache_key)}.json"
                )

                if not os.path.exists(metadata_file):
                    return None, None, False

                with open(metadata_file, 'r', encoding='utf-8') as f:
                    metadata = json.load(f)

                # Check if expired
                if self._is_expired(metadata.get('cached_at', '')):
                    return None, None, False

                # Get geometry file path
                geometry_file = os.path.join(
                    self.geometry_dir,
                    geometry_type,
                    f"{component_id}.pkl"
                )

                if os.path.exists(geometry_file):
                    with open(geometry_file, 'rb') as f:
                        mesh_json_strings = pickle.load(f)

                    # Reconstruct meshes from JSON using FromJSON
                    meshes = []
                    for json_string in mesh_json_strings:
                        try:
                            mesh = Rhino.Geometry.Mesh.FromJSON(json_string)
                            if mesh:
                                meshes.append(mesh)
                        except Exception as e:
                            # Log error but continue with other meshes
                            self._addError(
                                f"Error reconstructing mesh "
                                f"from JSON: {str(e)}")
                            continue

                    # If no meshes could be reconstructed, return failure
                    if not meshes:
                        return None, None, False

                    return meshes, metadata.get('etag'), True

                return None, None, False

            except (IOError, pickle.PickleError, KeyError):
                return None, None, False

    def set_geometry_binary(self, component_id, geometry_type, meshes, etag):
        """
        Cache geometry data as binary.

        Args:
            component_id: Component ID
            geometry_type: 'reduced' or 'detailed'
            meshes: List of Rhino.Geometry.Mesh objects
            etag: ETag from server response
        """
        with self._lock:
            try:
                current_time = datetime.now().isoformat()
                cache_key = f'geometry:{geometry_type}:{component_id}'

                # Create geometry subdirectory
                geometry_subdir = os.path.join(
                    self.geometry_dir, geometry_type
                )
                os.makedirs(geometry_subdir, exist_ok=True)

                # Convert meshes to JSON strings using ToJSON
                mesh_json_strings = []
                for mesh in meshes:
                    # Use ToJSON with SerializationOptions to include user data
                    options = Rhino.FileIO.SerializationOptions()
                    options.WriteUserData = True
                    options.WriteRenderMeshes = True
                    options.WriteAnalysisMeshes = True

                    json_string = mesh.ToJSON(options)
                    mesh_json_strings.append(json_string)

                # Store JSON strings as pickle
                geometry_file = os.path.join(
                    geometry_subdir, f"{component_id}.pkl"
                )
                with open(geometry_file, 'wb') as f:
                    pickle.dump(mesh_json_strings, f)

                # Store metadata
                metadata = {
                    'cache_key': cache_key,
                    'cached_at': current_time,
                    'etag': etag,
                    'type': 'geometry',
                    'geometry_type': geometry_type,
                    'component_id': component_id
                }

                metadata_file = os.path.join(
                    self.metadata_dir,
                    f"{self._get_cache_key_hash(cache_key)}.json"
                )
                with open(metadata_file, 'w', encoding='utf-8') as f:
                    json.dump(metadata, f, indent=2, ensure_ascii=False)

            except (IOError, pickle.PickleError, KeyError):
                # Silently fail cache writes to not break main functionality
                pass

    def _convert_obj_to_meshes(self, obj_content):
        """
        Convert OBJ file content to list of Rhino.Geometry.Mesh objects.
        Optimized version with improved performance for large files.
        Supports multiple objects (o object_0, o object_1, etc.) and
        v X Y Z R G B format with RGB integer colors.
        Returns list of mesh objects or empty list if conversion fails.
        """
        try:
            if not obj_content or not obj_content.strip():
                return []

            # Pre-allocate data structures for better performance
            meshes = []
            global_vertices = []
            global_normals = []
            global_vertex_colors = []

            # Current mesh data
            current_mesh_data = {
                'vertices': [],
                'faces': [],
                'normals': [],
                'vertex_colors': [],
                'name': 'default'
            }

            # Parse lines more efficiently
            lines = obj_content.splitlines()

            # Pre-process lines to avoid repeated string operations
            processed_lines = []
            for line in lines:
                line = line.strip()
                if line and not line.startswith('#'):
                    parts = line.split()
                    if parts:
                        processed_lines.append(parts)

            # Process lines without excessive logging
            for i, parts in enumerate(processed_lines):
                if parts[0] == 'o':  # object declaration
                    # Save previous mesh if it exists
                    if (current_mesh_data['vertices'] and
                            current_mesh_data['faces']):
                        mesh = self._create_mesh_from_data(current_mesh_data)
                        if mesh:
                            meshes.append(mesh)

                    # Start new mesh
                    current_mesh_data = {
                        'vertices': [],
                        'faces': [],
                        'normals': [],
                        'vertex_colors': [],
                        'name': (parts[1] if len(parts) > 1
                                 else f'object_{len(meshes)}')
                    }

                elif parts[0] == 'v':  # vertex
                    if len(parts) >= 4:
                        # Use tuple instead of Point3d for better performance
                        x = float(parts[1])
                        y = float(parts[2])
                        z = float(parts[3])
                        vertex = (x, y, z)
                        global_vertices.append(vertex)
                        current_mesh_data['vertices'].append(vertex)

                        # Check for vertex colors in v X Y Z R G B format
                        if len(parts) >= 7:
                            # Extract RGB integer values
                            r = int(parts[4])
                            g = int(parts[5])
                            b = int(parts[6])
                            color = (r, g, b)
                            global_vertex_colors.append(color)
                            current_mesh_data['vertex_colors'].append(color)
                        else:
                            # No color data, use default white
                            color = (255, 255, 255)
                            global_vertex_colors.append(color)
                            current_mesh_data['vertex_colors'].append(color)

                elif parts[0] == 'vn':  # vertex normal
                    if len(parts) >= 4:
                        nx = float(parts[1])
                        ny = float(parts[2])
                        nz = float(parts[3])
                        normal = (nx, ny, nz)
                        global_normals.append(normal)
                        current_mesh_data['normals'].append(normal)

                elif parts[0] == 'f':  # face
                    if len(parts) >= 4:
                        # Optimized face processing
                        face_vertices = []
                        for i in range(1, len(parts)):
                            # Handle different OBJ face formats
                            # (v, v/vt, v//vn, v/vt/vn)
                            vertex_part = parts[i].split('/')[0]
                            if vertex_part:
                                # OBJ is 1-indexed, convert to 0-indexed
                                vertex_index = int(vertex_part) - 1
                                if 0 <= vertex_index < len(global_vertices):
                                    # Use direct local index calculation
                                    vertices_len = len(
                                        current_mesh_data['vertices']
                                    )
                                    local_index = (
                                        vertex_index -
                                        (len(global_vertices) - vertices_len)
                                    )
                                    if (0 <= local_index < len(
                                            current_mesh_data['vertices'])):
                                        face_vertices.append(local_index)
                        if len(face_vertices) >= 3:
                            current_mesh_data['faces'].append(face_vertices)

            # Handle the last mesh
            if (current_mesh_data['vertices'] and
                    current_mesh_data['faces']):
                mesh = self._create_mesh_from_data(current_mesh_data)
                if mesh:
                    meshes.append(mesh)

            # If no objects were found, treat as single mesh
            # (backward compatibility)
            if not meshes and global_vertices:
                # Collect all faces from the global context
                global_faces = []
                for line in lines:
                    line = line.strip()
                    if (not line or line.startswith('#') or
                            line.startswith('o')):
                        continue
                    parts = line.split()
                    if not parts or parts[0] != 'f':
                        continue
                    if len(parts) >= 4:
                        face_vertices = []
                        for i in range(1, len(parts)):
                            vertex_part = parts[i].split('/')[0]
                            if vertex_part:
                                vertex_index = int(vertex_part) - 1
                                if 0 <= vertex_index < len(global_vertices):
                                    face_vertices.append(vertex_index)
                        if len(face_vertices) >= 3:
                            global_faces.append(face_vertices)

                if global_faces:
                    single_mesh = Rhino.Geometry.Mesh()
                    self._finalize_mesh(single_mesh, global_vertices,
                                        global_faces, global_normals,
                                        global_vertex_colors)
                    meshes.append(single_mesh)

            if not meshes:
                return []

            return meshes

        except Exception as e:
            self._addError(
                f"Error converting OBJ to meshes: {str(e)}")
            return []

    def _create_mesh_from_data(self, mesh_data):
        """
        Optimized method to create a Rhino mesh from pre-processed data.
        Uses bulk operations for better performance.
        """
        try:
            vertices = mesh_data['vertices']
            faces = mesh_data['faces']
            normals = mesh_data['normals']
            vertex_colors = mesh_data['vertex_colors']

            if not vertices or not faces:
                return None

            # Create mesh
            mesh = Rhino.Geometry.Mesh()

            # Convert tuples to Point3d objects in bulk
            point3d_vertices = []
            for x, y, z in vertices:
                point3d_vertices.append(Rhino.Geometry.Point3d(x, y, z))

            # Add vertices in bulk
            mesh.Vertices.AddVertices(point3d_vertices)

            # Add faces efficiently
            for face in faces:
                if len(face) == 3:
                    mesh.Faces.AddFace(face[0], face[1], face[2])
                elif len(face) == 4:
                    mesh.Faces.AddFace(face[0], face[1], face[2], face[3])
                else:
                    # Triangulate polygon faces
                    for i in range(1, len(face) - 1):
                        mesh.Faces.AddFace(face[0], face[i], face[i + 1])

            # Add normals if available
            if normals and len(normals) == len(vertices):
                mesh.Normals.Clear()
                for nx, ny, nz in normals:
                    mesh.Normals.Add(Rhino.Geometry.Vector3d(nx, ny, nz))
                mesh.Normals.ComputeNormals()
            else:
                mesh.Normals.ComputeNormals()

            # Add vertex colors if available
            if vertex_colors and len(vertex_colors) == len(vertices):
                for r, g, b in vertex_colors:
                    mesh.VertexColors.Add(r, g, b)

            # Apply coordinate system transformation
            mesh.Rotate(
                (math.pi / 2),
                Rhino.Geometry.Plane.WorldXY.XAxis,
                Rhino.Geometry.Point3d(0, 0, 0)
            )

            # Set mesh name
            mesh.UserDictionary.Set('Name', mesh_data['name'])

            # Compute mesh properties
            mesh.Compact()

            return mesh

        except Exception as e:
            self._addError(
                f"Error creating mesh from data: {str(e)}")
            return None

    def _finalize_mesh(self, mesh, vertices, faces, normals, vertex_colors):
        """
        Helper method to finalize a mesh with vertices, faces, normals,
        and colors.
        """
        try:
            # Add vertices
            for vertex in vertices:
                mesh.Vertices.Add(vertex)

            # Add faces
            for face in faces:
                if len(face) == 3:
                    mesh.Faces.AddFace(face[0], face[1], face[2])
                elif len(face) == 4:
                    mesh.Faces.AddFace(face[0], face[1], face[2], face[3])
                else:
                    # Triangulate polygon faces
                    for i in range(1, len(face) - 1):
                        mesh.Faces.AddFace(face[0], face[i], face[i + 1])

            # Add normals if available
            if normals and len(normals) == len(vertices):
                mesh.Normals.Clear()
                for normal in normals:
                    mesh.Normals.Add(normal)
                mesh.Normals.ComputeNormals()
            else:
                mesh.Normals.ComputeNormals()

            # Add vertex colors if available
            if vertex_colors and len(vertex_colors) == len(vertices):
                for color in vertex_colors:
                    r, g, b = color
                    mesh.VertexColors.Add(r, g, b)

            # rotate around x-axis to normalize for Rhino
            mesh.Rotate(
                (math.pi / 2),
                Rhino.Geometry.Plane.WorldXY.XAxis,
                Rhino.Geometry.Point3d(0, 0, 0)
            )
            # Compute mesh properties
            mesh.Compact()

        except Exception as e:
            self._addError(
                f"Error finalizing mesh: {str(e)}")
            return None


# AuthCore - Embedded ---------------------------------------------------------

class _AuthCore(object):
    """
    Authorization and cache management tool that gets stored in sticky to be
    used by other CSC Grasshopper Components.

    Author: Max Benjamin Eschenbach
    License: MIT License
    """

    def __init__(self, base_url, leeway=30, disable_cache=False):
        self.base_url = (base_url or 'https://api.ddu.uber.space').rstrip('/')
        self.leeway = int(leeway) if leeway is not None else 30
        self.disable_cache = disable_cache
        self._lock = RLock()
        self._token = None
        self._exp = 0
        self._username = None
        self._cache = None if disable_cache else _ComponentCache()

    @staticmethod
    def _now():
        return int(time.time())

    @staticmethod
    def _b64url_decode(seg):
        rem = len(seg) % 4
        if rem:
            seg += '=' * (4 - rem)
        return base64.urlsafe_b64decode(seg.encode('utf-8'))

    @classmethod
    def _jwt_payload(cls, token):
        try:
            parts = token.split('.')
            if len(parts) != 3:
                return {}
            return json.loads(cls._b64url_decode(parts[1]).decode('utf-8'))
        except Exception:
            return {}

    def set_access_token(self, token, username=None):
        payload = self._jwt_payload(token)
        exp = int(payload.get('exp', 0))
        if exp <= 0:
            exp = self._now() + 3600  # 1h fallback if no exp claim
        with self._lock:
            self._token = token
            self._exp = exp
            if username:
                self._username = username

    def clear(self):
        with self._lock:
            self._token = None
            self._exp = 0
            self._username = None

    def is_valid(self):
        with self._lock:
            if not self._token or self._exp <= 0:
                return False
            return (self._now() + self.leeway) < self._exp

    def get_username(self):
        with self._lock:
            return self._username

    def auth_header(self):
        with self._lock:
            return ({'Authorization': 'Bearer ' + self._token}
                    if self._token else {})

    def authorized_get(
            self,
            path,
            params=None,
            extra_headers=None,
            timeout=20):
        if not self.is_valid():
            raise RuntimeError(
                'Access token missing or expired. Please sign in again.'
            )
        headers = self.auth_header()
        if extra_headers:
            headers.update(extra_headers)
        return requests.get(
            self.base_url + path,
            params=params,
            headers=headers,
            timeout=timeout
        )

    def authorized_post(
            self,
            path,
            json_body=None,
            files=None,
            extra_headers=None,
            timeout=60):
        if not self.is_valid():
            raise RuntimeError(
                'Access token missing or expired. Please sign in again.'
            )
        headers = self.auth_header()
        if extra_headers:
            headers.update(extra_headers)
        # Handle file uploads vs JSON requests
        if files is not None:
            # For file uploads, don't set Content-Type header
            # (let requests handle it)
            # and use data instead of json
            return requests.post(
                self.base_url + path,
                files=files,
                headers=headers,
                timeout=timeout
            )
        else:
            # For JSON requests, use json parameter
            return requests.post(
                self.base_url + path,
                json=json_body,
                headers=headers,
                timeout=timeout
            )

    def validate_uuid(self, uuid_to_test: str, version: int = 4):
        """
        Check if uuid_to_test is a valid UUID.
        Returns True if uuid_to_test is a valid UUID, otherwise False.
        """
        try:
            uuid_obj = uuid.UUID(uuid_to_test, version=version)
        except ValueError:
            return False
        return str(uuid_obj) == uuid_to_test

    # Cache Management Methods ------------------------------------------------

    def get_cache(self):
        """Get the cache instance."""
        return self._cache

    def set_cache_enabled(self, enabled):
        """Enable or disable caching."""
        with self._lock:
            self.disable_cache = not enabled
            if enabled and self._cache is None:
                self._cache = _ComponentCache()
            elif not enabled:
                self._cache = None

    def is_cache_enabled(self):
        """Check if caching is enabled."""
        return self._cache is not None

    def sync_cache(self):
        """Force cache synchronization (clear cache)."""
        if self._cache:
            self._cache.invalidate()

    def get_cache_stats(self):
        """Get cache statistics."""
        if self._cache:
            return self._cache.get_cache_stats()
        return {
            'component_count': 0,
            'metadata_count': 0,
            'total_size_bytes': 0,
            'cache_dir': 'Cache disabled'
        }

    def cached_get(
            self,
            path,
            cache_key,
            params=None,
            extra_headers=None,
            timeout=20):
        """
        Make a cached GET request with ETag support.

        Args:
            path: API path
            cache_key: Cache key for this request
            params: Query parameters
            extra_headers: Additional headers
            timeout: Request timeout

        Returns:
            Response object
        """
        if not self.is_valid():
            raise RuntimeError(
                'Access token missing or expired. Please sign in again.'
            )

        # If cache is disabled, make regular request
        if not self._cache:
            return self.authorized_get(path, params, extra_headers, timeout)

        # Check cache first
        cached_data, cached_etag, is_from_cache = self._cache.get(cache_key)

        # Prepare headers
        headers = self.auth_header()
        if extra_headers:
            headers.update(extra_headers)

        # Add conditional request header if we have cached data
        if is_from_cache and cached_etag:
            headers['If-None-Match'] = cached_etag

        # Make request
        response = requests.get(
            self.base_url + path,
            params=params,
            headers=headers,
            timeout=timeout
        )

        # Handle response
        if response.status_code == 304 and is_from_cache:
            # Not modified - return cached data
            # Create a mock response with cached data
            class MockResponse:
                def __init__(self, data, etag):
                    self.status_code = 200
                    self._data = data
                    self._etag = etag

                def json(self):
                    return self._data

                @property
                def headers(self):
                    return {'ETag': self._etag} if self._etag else {}

            return MockResponse(cached_data, cached_etag)

        elif response.status_code == 200:
            # Data changed or first request - cache the response
            try:
                data = response.json()
                etag = response.headers.get('ETag')
                self._cache.set(cache_key, data, etag, params)
            except (ValueError, KeyError):
                # If we can't parse JSON or cache, just return response
                pass

        return response

    def cached_get_geometry(self, component_id, geometry_type, timeout=60):
        """
        Make a cached GET request for geometry with ETag support.

        Args:
            component_id: Component ID
            geometry_type: 'reduced' or 'detailed'
            timeout: Request timeout

        Returns:
            Response object with geometry data
        """
        if not self.is_valid():
            raise RuntimeError(
                'Access token missing or expired. Please sign in again.'
            )

        # If cache is disabled, make regular request
        if not self._cache:
            path = f'/components/{component_id}/geometry_{geometry_type}'
            return self.authorized_get(path, timeout=timeout)

        # Check binary cache first
        (cached_meshes,
         cached_etag,
         is_from_binary_cache) = self._cache.get_geometry_binary(
            component_id, geometry_type)

        # Prepare headers
        headers = self.auth_header()

        # Add conditional request header if we have cached data
        if is_from_binary_cache and cached_etag:
            headers['If-None-Match'] = cached_etag

        # Make request
        path = f'/components/{component_id}/geometry_{geometry_type}'
        response = requests.get(
            self.base_url + path,
            headers=headers,
            timeout=timeout
        )

        # Handle response
        if response.status_code == 304 and is_from_binary_cache:
            # Not modified - return cached data as OBJ text
            # Convert cached meshes back to OBJ for compatibility
            try:
                obj_text = self._convert_meshes_to_obj(cached_meshes)
            except Exception:
                # Fallback: return empty OBJ
                obj_text = "# No geometry data available"

            class MockResponse:
                def __init__(self, data, etag):
                    self.status_code = 200
                    self._data = data
                    self._etag = etag

                @property
                def text(self):
                    return self._data

                @property
                def headers(self):
                    return {'ETag': self._etag} if self._etag else {}

            return MockResponse(obj_text, cached_etag)

        elif response.status_code == 200:
            # Data changed or first request - cache the response
            try:
                geometry_data = response.text
                etag = response.headers.get('ETag')
                # Use the updated set_geometry method which converts to binary
                self._cache.set_geometry(
                    component_id, geometry_type, geometry_data, etag
                )
            except (ValueError, KeyError):
                # If we can't cache, just return response
                pass

        return response

    def get_component_schema(self, force_refresh=False):
        """
        Get component schema with caching support.

        Args:
            force_refresh: Force refresh of schema even if cached

        Returns:
            Component schema dictionary or None if failed
        """
        # Schema endpoints are unprotected, so we can access without auth
        # But we still need to check if we have a valid base_url
        if not self.base_url:
            raise RuntimeError(
                'Base URL not configured. Please sign in first.')

        # If cache is disabled, make regular request
        # (schema endpoint is unprotected)
        if not self._cache:
            try:
                response = requests.get(f'{self.base_url}/schema/component')
                if response.status_code == 200:
                    return response.json()
                return None
            except Exception:
                return None

        # Check cache first (unless force refresh)
        if not force_refresh:
            cached_schema, cached_etag, is_from_cache = self._cache.get(
                'schema:component')
            if is_from_cache:
                return cached_schema

        # Make request to get schema (unprotected endpoint)
        try:
            # Prepare headers for conditional request
            headers = {}
            if not force_refresh:
                cached_schema, cached_etag, is_from_cache = self._cache.get(
                    'schema:component')
                if is_from_cache and cached_etag:
                    headers['If-None-Match'] = cached_etag

            response = requests.get(f'{self.base_url}/schema/component',
                                    headers=headers)

            if response.status_code == 304 and not force_refresh:
                # Not modified - return cached data
                cached_schema, _, is_from_cache = self._cache.get(
                    'schema:component')
                if is_from_cache:
                    return cached_schema

            elif response.status_code == 200:
                # Data changed or first request - cache the response
                try:
                    data = response.json()
                    etag = response.headers.get('ETag')
                    self._cache.set('schema:component', data, etag)
                    return data
                except (ValueError, KeyError):
                    return None

            return None
        except Exception:
            # If request fails and we have cached schema, return cached version
            if not force_refresh:
                cached_schema, _, is_from_cache = self._cache.get(
                    'schema:component')
                if is_from_cache:
                    return cached_schema
            return None

    def get_design_schema(self, force_refresh=False):
        """
        Get design schema with caching support.

        Args:
            force_refresh: Force refresh of schema even if cached

        Returns:
            Design schema dictionary or None if failed
        """
        # Schema endpoints are unprotected, so we can access without auth
        # But we still need to check if we have a valid base_url
        if not self.base_url:
            raise RuntimeError(
                'Base URL not configured. Please sign in first.')

        # If cache is disabled, make regular request
        # (schema endpoint is unprotected)
        if not self._cache:
            try:
                response = requests.get(f'{self.base_url}/schema/design')
                if response.status_code == 200:
                    return response.json()
                return None
            except Exception:
                return None

        # Check cache first (unless force refresh)
        if not force_refresh:
            cached_schema, cached_etag, is_from_cache = self._cache.get(
                'schema:design')
            if is_from_cache:
                return cached_schema

        # Make request to get schema (unprotected endpoint)
        try:
            # Prepare headers for conditional request
            headers = {}
            if not force_refresh:
                cached_schema, cached_etag, is_from_cache = self._cache.get(
                    'schema:design')
                if is_from_cache and cached_etag:
                    headers['If-None-Match'] = cached_etag

            response = requests.get(f'{self.base_url}/schema/design',
                                    headers=headers)

            if response.status_code == 304 and not force_refresh:
                # Not modified - return cached data
                cached_schema, _, is_from_cache = self._cache.get(
                    'schema:design')
                if is_from_cache:
                    return cached_schema

            elif response.status_code == 200:
                # Data changed or first request - cache the response
                try:
                    data = response.json()
                    etag = response.headers.get('ETag')
                    self._cache.set('schema:design', data, etag)
                    return data
                except (ValueError, KeyError):
                    return None

            return None
        except Exception:
            # If request fails and we have cached schema, return cached version
            if not force_refresh:
                cached_schema, _, is_from_cache = self._cache.get(
                    'schema:design')
                if is_from_cache:
                    return cached_schema
            return None

    def _convert_meshes_to_obj(self, meshes):
        """
        Convert Rhino.Geometry.Mesh objects to OBJ file content.
        This is used for compatibility when returning cached binary data
        as OBJ text.
        """
        try:
            if not meshes:
                return "# No geometry data available"

            obj_lines = []
            vertex_offset = 0

            for mesh_idx, mesh in enumerate(meshes):
                # Add object declaration
                obj_lines.append(f"o object_{mesh_idx}")

                # Add vertices
                for i in range(mesh.Vertices.Count):
                    vertex = mesh.Vertices[i]
                    obj_lines.append(f"v {vertex.X} {vertex.Y} {vertex.Z}")

                # Add vertex colors if available
                if mesh.VertexColors.Count > 0:
                    for i in range(mesh.Vertices.Count):
                        if i < mesh.VertexColors.Count:
                            color = mesh.VertexColors[i]
                            obj_lines.append(
                                f"v {mesh.Vertices[i].X} "
                                f"{mesh.Vertices[i].Y} "
                                f"{mesh.Vertices[i].Z} "
                                f"{color.R} {color.G} {color.B}"
                            )
                        else:
                            vertex = mesh.Vertices[i]
                            obj_lines.append(
                                f"v {vertex.X} {vertex.Y} {vertex.Z}"
                            )

                # Add faces (adjust indices for OBJ format)
                for i in range(mesh.Faces.Count):
                    face = mesh.Faces[i]
                    if face.IsTriangle:
                        obj_lines.append(
                            f"f {face.A + vertex_offset + 1} "
                            f"{face.B + vertex_offset + 1} "
                            f"{face.C + vertex_offset + 1}"
                        )
                    elif face.IsQuad:
                        obj_lines.append(
                            f"f {face.A + vertex_offset + 1} "
                            f"{face.B + vertex_offset + 1} "
                            f"{face.C + vertex_offset + 1} "
                            f"{face.D + vertex_offset + 1}"
                        )

                vertex_offset += mesh.Vertices.Count

            return "\n".join(obj_lines)

        except Exception as e:
            return f"# Error converting meshes to OBJ: {str(e)}"


# SignIn Grasshopper Component ------------------------------------------------

class CSC_Session(Grasshopper.Kernel.GH_ScriptInstance):
    """
    Author: Max Benjamin Eschenbach
    License: MIT License
    """

    # Development setting - do not change!
    __HARD_RESET = False

    def __init__(self):
        """Initialize this component and set component parameters."""
        super().__init__()
        # initialize props
        self.Component = ghenv.Component  # type: ignore[reportUnedfinedVariable] # NOQA
        self.InputParams = self.Component.Params.Input
        self.OutputParams = self.Component.Params.Output

    def _addRemark(self, msg: str = ''):
        """Add a remark message to the component."""
        rml = self.Component.RuntimeMessageLevel.Remark
        self.AddRuntimeMessage(rml, msg)

    def _addWarning(self, msg: str = ''):
        """Add a warning message to the component."""
        rml = self.Component.RuntimeMessageLevel.Warning
        self.AddRuntimeMessage(rml, msg)

    def _addError(self, msg: str = ''):
        """Add an error message to the component."""
        rml = self.Component.RuntimeMessageLevel.Error
        self.AddRuntimeMessage(rml, msg)

    def BeforeRunScript(self):
        """Perform some setup actions."""
        # Initialize input param descriptions
        self.InputParams[0].Description = 'Your Username or E-Mail'
        self.InputParams[1].Description = 'Your password'
        self.InputParams[2].Description = (
            'Refresh toggle, press when your token expired'
        )
        self.InputParams[3].Description = (
            'Disable caching (default: False - caching enabled)'
        )
        self.InputParams[4].Description = (
            'Clear cache (default: False)'
        )
        # Initialize output param descriptions
        i = 0
        if self.OutputParams[0].Name == 'out':
            i += 1
        self.OutputParams[0+i].Description = (
            'Status Message'
        )

    def get_auth_core_from_sticky(self):
        """Get AuthCore instance from sticky storage or create new one."""
        if not self.__HARD_RESET:
            auth_core = sc.sticky.get('CSC_AuthCore')
        else:
            auth_core = None
        if auth_core is None:
            # Create new AuthCore instance with default settings
            auth_core = _AuthCore(
                base_url='https://api.ddu.uber.space'
            )
            sc.sticky['CSC_AuthCore'] = auth_core
        return auth_core

    def RunScript(self,
            Username: str,
            Password: str,
            Refresh: bool,
            DisableCache: bool,
            ClearCache: bool):
        # Initialize status messages list
        status_messages = []

        # Sanitize input parameters (defaults don't work in function signature)
        if DisableCache is None:
            DisableCache = False
        if ClearCache is None:
            ClearCache = False

        # Get or create AuthCore instance
        auth_core = self.get_auth_core_from_sticky()

        # Handle cache management
        if ClearCache:
            auth_core.sync_cache()
            status_messages.append('Cache cleared')
            self.Component.Message = 'Cache cleared'
            # Return status messages
            Status = status_messages
            return (Status,)

        # Set cache enabled/disabled
        auth_core.set_cache_enabled(not DisableCache)

        # Input validation
        if not Username or not Username.strip():
            status_messages.append('Please provide username/email')
            self.Component.Message = 'Please provide username/email'
            Status = status_messages
            return (Status,)

        if not Password or not Password.strip():
            status_messages.append('Please provide password')
            self.Component.Message = 'Please provide password'
            Status = status_messages
            return (Status,)

        username = Username.strip()
        password = Password.strip()

        try:
            if Refresh:
                # Refresh authentication - clear existing token and re-auth
                auth_core.clear()
                self.Component.Message = 'Refreshing authentication...'
            else:
                # Check if we already have a valid token
                if auth_core.is_valid():
                    current_user = auth_core.get_username()
                    self.Component.Message = (
                        f'Already signed in as: {current_user}'
                    )

                    # Fetch and cache component schema
                    try:
                        schema = auth_core.get_component_schema()
                        if schema:
                            status_messages.append(
                                'Schema cached successfully')
                            self._addRemark('Schema cached successfully')
                        else:
                            status_messages.append('Failed to cache schema')
                            self._addWarning('Failed to cache schema')
                    except Exception as e:
                        status_messages.append(
                            f'Schema caching failed: {str(e)}')
                        self._addWarning(f'Schema cache failed: {str(e)}')

                    # Get cache status for output
                    cache_stats = auth_core.get_cache_stats()
                    cache_enabled = auth_core.is_cache_enabled()
                    comp_count = cache_stats["component_count"]
                    geometry_count = cache_stats["geometry_count"]
                    design_count = cache_stats["design_count"]
                    size_kb = cache_stats["total_size_bytes"] // 1024
                    geometry_size_kb = (
                        cache_stats["geometry_size_bytes"] // 1024
                    )
                    design_size_kb = (
                        cache_stats["design_size_bytes"] // 1024
                    )

                    # Add cache status to messages
                    cache_status = (
                        'Cache: '
                        f'{"Enabled" if cache_enabled else "Disabled"}\n'
                        f' | Components: {comp_count}\n'
                        f' | Geometry: {geometry_count} files\n'
                        f' | Designs: {design_count} files\n'
                        f' | Size: {size_kb} kB\n'
                        f' | Geometry: {geometry_size_kb} kB\n'
                        f' | Designs: {design_size_kb} kB\n')
                    status_messages.append(cache_status)
                    Status = status_messages
                    return (Status,)

                self.Component.Message = 'Signing in...'

            # Prepare login data
            login_data = {
                'username': username,
                'password': password
            }

            # Make login request
            response = requests.post(
                f'{auth_core.base_url}/auth/token',
                data=login_data,
                headers={
                    'Content-Type': 'application/x-www-form-urlencoded'
                },
                timeout=20
            )

            if response.status_code == 200:
                # Login successful
                token_data = response.json()
                access_token = token_data.get('access_token')

                if access_token:
                    # Store token in AuthCore
                    auth_core.set_access_token(access_token, username)

                    # Update sticky storage
                    sc.sticky['CSC_AuthCore'] = auth_core

                    # Fetch and cache component schema
                    try:
                        schema = auth_core.get_component_schema()
                        if schema:
                            status_messages.append(
                                'Schema cached successfully')
                            self._addRemark('Schema cached successfully')
                        else:
                            status_messages.append('Failed to cache schema')
                            self._addWarning('Failed to cache schema')
                    except Exception as e:
                        status_messages.append(
                            f'Schema caching failed: {str(e)}')
                        self._addWarning(f'Schema cache failed: {str(e)}')

                    # Get cache status for output
                    cache_stats = auth_core.get_cache_stats()
                    cache_enabled = auth_core.is_cache_enabled()
                    comp_count = cache_stats["component_count"]
                    geometry_count = cache_stats["geometry_count"]
                    design_count = cache_stats["design_count"]
                    size_kb = cache_stats["total_size_bytes"] // 1024
                    geometry_size_kb = (
                        cache_stats["geometry_size_bytes"] // 1024
                    )
                    design_size_kb = (
                        cache_stats["design_size_bytes"] // 1024
                    )

                    # Add cache status to messages
                    cache_status = (
                        f'Cache: '
                        f'{"Enabled" if cache_enabled else "Disabled"}\n'
                        f' | Components: {comp_count}\n'
                        f' | Geometry: {geometry_count} files\n'
                        f' | Designs: {design_count} files\n'
                        f' | Size: {size_kb} kB\n'
                        f' | Geometry: {geometry_size_kb} kB\n'
                        f' | Designs: {design_size_kb} kB\n')
                    status_messages.append(cache_status)

                    self.Component.Message = f'Signed in as: {username}'

                    # Return status messages
                    Status = status_messages
                    return (Status,)

                else:
                    msg = 'Login failed: No token received'
                    status_messages.append(msg)
                    self._addWarning(msg)
                    self.Component.Message = msg
                    Status = status_messages
                    return (Status,)

            elif response.status_code == 401:
                msg = 'Invalid username or password'
                status_messages.append(msg)
                self._addError(msg)
                self.Component.Message = msg
                Status = status_messages
                return (Status,)

            elif response.status_code == 422:
                msg = 'Invalid input data'
                status_messages.append(msg)
                self._addError(msg)
                self.Component.Message = msg
                Status = status_messages
                return (Status,)

            elif response.status_code == 500:
                msg = 'Server error - please try again'
                status_messages.append(msg)
                self._addWarning(msg)
                self.Component.Message = msg
                Status = status_messages
                return (Status,)

            else:
                msg = f'Login failed with status code: {response.status_code}'
                status_messages.append(msg)
                self._addError(msg)
                self.Component.Message = msg
                Status = status_messages
                return (Status,)

        except requests.exceptions.ConnectionError as e:
            msg = 'Cannot connect to server - check URL'
            status_messages.append(msg)
            self._addError(msg + f'\nFull Error: {str(e)}')
            self.Component.Message = msg
            Status = status_messages
            return (Status,)

        except requests.exceptions.Timeout as e:
            msg = 'Request timeout - server may be slow'
            status_messages.append(msg)
            self._addError(msg + f'\nFull Error: {str(e)}')
            self.Component.Message = msg
            Status = status_messages
            return (Status,)

        except requests.exceptions.RequestException as e:
            msg = f'Request error: {str(e)}'
            status_messages.append(msg)
            self._addError(msg)
            self.Component.Message = msg
            Status = status_messages
            return (Status,)

        except Exception as e:
            msg = f'Unexpected error: {str(e)}'
            status_messages.append(msg)
            self.Component.Message = msg
            Status = status_messages
            return (Status,)
# ---------- end csc_session ----------
status_messages = Panel(csc_session)

# comments & notes: Fetch a subset of components from the database using filters. Here we are fetching the 'mineral_composite_panels' dataset.
# 
# NOTE: ReservedStatus = -1 means we ignore reservations entirely
# Step 3
mindimensionx = Slider(0, range=-0.1..2000)
maxdimensionx = Slider(0, range=0..2000)
maxdimensiony = Slider(0, range=0..2000)
maxdimensionz = Slider(0, range=0..500)
mindimensiony = Slider(0, range=0..2000)
mindimensionz = Slider(0, range=0..500)
reservedstatus = Slider(-1, range=-1..1)
fragment = ValueList({"Any": , "Only fragments": True, "Only non-fragmnents": False}, selected="Any")
dataset = Panel("mineral_composite_panels")
complexity = ValueList({"Any complexity": , "0", "1", "2", "3"}, selected="Any complexity")
material = ValueList({"Any material": , "corian", "concrete", "timber", "aluminium", "steel"}, selected="Any material")
type = ValueList({"All types": , "panel", "beam", "column", "slab", "rubble", "brick", "pipe", "profile", "connector", "other"}, selected="All types")
fetchfilteredcomponents = FetchFilteredComponents(
    Type=type,
    Material=material,
    Dataset=dataset,
    Complexity=complexity,
    Fragment=fragment,
    MinDimensionX=mindimensionx,
    MaxDimensionX=maxdimensionx,
    MinDimensionY=mindimensiony,
    MaxDimensionY=maxdimensiony,
    MinDimensionZ=mindimensionz,
    MaxDimensionZ=maxdimensionz,
    ReservedStatus=reservedstatus)  # -> FilterDescription, ComponentData; inputs Type: String, Material: String, Dataset: String, Complexity: Int32, Fragment: Boolean, MinDimensionX: Double, MaxDimensionX: Double, MinDimensionY: Double, MaxDimensionY: Double, MinDimensionZ: Double, MaxDimensionZ: Double
# ---------- fetchfilteredcomponents: Python ----------
#! python3
# -*- coding: utf-8 -*-
# venv: DDU_CSC
print('ENV OK!')
# r: charset_normalizer
# r: requests
# r: numpy
# r: scipy
# r: scikit-learn
# r: robust-laplacian
# r: potpourri3d

# PYTHON STANDARD LIBRARY IMPORTS ---------------------------------------------
import json  # NOQA

# THIRD PARTY LIBRARY IMPORTS -------------------------------------------------
import requests  # NOQA

# RHINO AND GH RELATED IMPORTS ------------------------------------------------
import System  # NOQA
import Grasshopper  # NOQA
import Rhino  # NOQA
import scriptcontext as sc  # NOQA

# GHENV COMPONENT SETTINGS ----------------------------------------------------
ghenv.Component.Name = 'FetchFilteredComponents'  # NOQA
ghenv.Component.NickName = 'FetchFilteredComponents'  # NOQA
ghenv.Component.Category = 'DDU_CSC'  # NOQA
ghenv.Component.SubCategory = '2 Catalog Interface'  # NOQA
ghenv.Component.Description = (  # NOQA
    'Fetches components from the remote Catalog based on filter criteria '
    '(type, material, dataset, complexity, dimensions, reservation status). '
    'Builds query parameters and returns filtered results.'
)


class CSC_FetchFilteredComponents(Grasshopper.Kernel.GH_ScriptInstance):
    """
    Author: Max Benjamin Eschenbach
    License: MIT License
    Version: 260316
    """

    def __init__(self):
        """Initialize this component and set component parameters."""
        super().__init__()
        # initialize props
        self.Component = ghenv.Component  # NOQA
        self.InputParams = self.Component.Params.Input
        self.OutputParams = self.Component.Params.Output

    def _addRemark(self, msg: str = ''):
        """Add a remark message to the component."""
        rml = self.Component.RuntimeMessageLevel.Remark
        self.AddRuntimeMessage(rml, msg)

    def _addWarning(self, msg: str = ''):
        """Add a warning message to the component."""
        rml = self.Component.RuntimeMessageLevel.Warning
        self.AddRuntimeMessage(rml, msg)

    def _addError(self, msg: str = ''):
        """Add an error message to the component."""
        rml = self.Component.RuntimeMessageLevel.Error
        self.AddRuntimeMessage(rml, msg)

    def BeforeRunScript(self):
        """Perform some setup actions."""
        # Initialize input param descriptions
        self.InputParams[0].Description = (
            'Component type filter (e.g., "beam", "slab", "column")'
        )
        self.InputParams[1].Description = (
            'Material type filter (e.g., "concrete", "steel", "wood")'
        )
        self.InputParams[2].Description = (
            'Dataset name filter (e.g., "sas_cita_scans", '
            '"mineral_composite_sheets")'
        )
        self.InputParams[3].Description = (
            'Complexity level filter (0-3, where 0=simple, 3=complex)'
        )
        self.InputParams[4].Description = (
            'Fragment status filter (True for fragments, False for complete)'
        )
        self.InputParams[5].Description = (
            'Minimum X dimension filter (bounding box)'
        )
        self.InputParams[6].Description = (
            'Maximum X dimension filter (bounding box)'
        )
        self.InputParams[7].Description = (
            'Minimum Y dimension filter (bounding box)'
        )
        self.InputParams[8].Description = (
            'Maximum Y dimension filter (bounding box)'
        )
        self.InputParams[9].Description = (
            'Minimum Z dimension filter (bounding box)'
        )
        self.InputParams[10].Description = (
            'Maximum Z dimension filter (bounding box)'
        )
        self.InputParams[11].Description = (
            'Reservation status filter: -1=ignore, 0=not reserved, '
            '1=reserved by current user'
        )
        # Initialize output param descriptions
        i = 0
        if self.OutputParams[0].Name == 'out':
            i += 1
        self.OutputParams[0+i].Description = (
            'Human-readable description of the applied filters and query'
        )
        self.OutputParams[1+i].Description = (
            'The ComponentData that was fetched from the server as JSON. '
            'Use \'DisassembleComponent\' to access the individual fields '
            'ready for Grasshopper')

    def get_auth_core_from_sticky(self):
        """Get AuthCore instance from sticky storage."""
        auth_core = sc.sticky.get('CSC_AuthCore')
        if auth_core is None:
            msg = ('No authentication found. Please use CSC_Session component '
                   'first.')
            self._addError(msg)
            self.Component.Message = msg
            return None
        return auth_core

    def build_filter_query_params(
            self,
            Type,
            Material,
            Dataset,
            Complexity,
            Fragment,
            MinDimensionX,
            MaxDimensionX,
            MinDimensionY,
            MaxDimensionY,
            MinDimensionZ,
            MaxDimensionZ,
            ReservedStatus):
        """Build query parameters for filtering components."""
        params = {}

        # Add type filter if provided
        if Type and len(Type) > 0:
            # Take the first type if multiple are provided
            type_value = Type[0] if isinstance(Type, list) else str(Type)
            if type_value and type_value.strip():
                params['comptype'] = type_value.strip()

        # Add material filter if provided
        if Material and Material.strip():
            params['material'] = Material.strip()

        # Add dataset filter if provided
        if Dataset and Dataset.strip():
            params['dataset'] = Dataset.strip()

        # Add complexity filter if provided
        if Complexity is not None:
            params['complexity'] = Complexity

        # Add fragment filter if provided
        if Fragment is not None:
            params['fragment'] = Fragment

        # Add reservation status filter if provided
        if ReservedStatus is not None and ReservedStatus != -1:
            if ReservedStatus == 0:
                # Fetch components that are not reserved by anyone
                params['reserved'] = 'false'
            elif ReservedStatus == 1:
                # Fetch components reserved by current user
                params['reserved'] = 'true'

        # Add bounding box filters if provided
        if MinDimensionX is not None and MinDimensionX != 0.0:
            params['bbx_min_x'] = MinDimensionX
        if MaxDimensionX is not None and MaxDimensionX != 0.0:
            params['bbx_max_x'] = MaxDimensionX
        if MinDimensionY is not None and MinDimensionY != 0.0:
            params['bbx_min_y'] = MinDimensionY
        if MaxDimensionY is not None and MaxDimensionY != 0.0:
            params['bbx_max_y'] = MaxDimensionY
        if MinDimensionZ is not None and MinDimensionZ != 0.0:
            params['bbx_min_z'] = MinDimensionZ
        if MaxDimensionZ is not None and MaxDimensionZ != 0.0:
            params['bbx_max_z'] = MaxDimensionZ

        return params

    def generate_filter_description(self, filter_params: dict) -> str:
        """Generates a human-readable description of the applied filters."""
        description = []
        if filter_params.get('comptype'):
            description.append(f'\nType: {filter_params["comptype"]}')
        if filter_params.get('material'):
            description.append(f'\nMaterial: {filter_params["material"]}')
        if filter_params.get('dataset'):
            description.append(f'\nDataset: {filter_params["dataset"]}')
        if filter_params.get('complexity') is not None:
            description.append(f'\nComplexity: {filter_params["complexity"]}')
        if filter_params.get('fragment') is not None:
            description.append(f'\nFragment: {filter_params["fragment"]}')

        # Add reservation status filter description
        if filter_params.get('reserved') == 'false':
            description.append('\nReservation: Not reserved by anyone')
        elif filter_params.get('reserved') == 'true':
            description.append('\nReservation: Reserved by current user')

        # Handle bounding box filters with detailed information
        bbx_filters = []
        if filter_params.get('bbx_min_x') is not None:
            bbx_filters.append(f'\nX >= {filter_params["bbx_min_x"]:.2f}')
        if filter_params.get('bbx_max_x') is not None:
            bbx_filters.append(f'\nX <= {filter_params["bbx_max_x"]:.2f}')
        if filter_params.get('bbx_min_y') is not None:
            bbx_filters.append(f'\nY >= {filter_params["bbx_min_y"]:.2f}')
        if filter_params.get('bbx_max_y') is not None:
            bbx_filters.append(f'\nY <= {filter_params["bbx_max_y"]:.2f}')
        if filter_params.get('bbx_min_z') is not None:
            bbx_filters.append(f'\nZ >= {filter_params["bbx_min_z"]:.2f}')
        if filter_params.get('bbx_max_z') is not None:
            bbx_filters.append(f'\nZ <= {filter_params["bbx_max_z"]:.2f}')

        if bbx_filters:
            description.append(f'\nBounding Box: {", ".join(bbx_filters)}')

        return f'Applied filters: {", ".join(description)}'

    def RunScript(self,
            Type: str,
            Material: str,
            Dataset: str,
            Complexity: int,
            Fragment: bool,
            MinDimensionX: float,
            MaxDimensionX: float,
            MinDimensionY: float,
            MaxDimensionY: float,
            MinDimensionZ: float,
            MaxDimensionZ: float,
            ReservedStatus):

        # Get AuthCore instance from sticky storage
        auth_core = self.get_auth_core_from_sticky()
        if auth_core is None:
            return

        # Check if authentication is valid
        if not auth_core.is_valid():
            msg = ('Authentication expired. Please use CSC_Session '
                   'component to refresh.')
            self._addError(msg)
            self.Component.Message = msg
            return

        try:
            self.Component.Message = 'Building filter query...'

            # Build filter query parameters
            filter_params = self.build_filter_query_params(
                Type, Material, Dataset, Complexity, Fragment,
                MinDimensionX, MaxDimensionX, MinDimensionY,
                MaxDimensionY, MinDimensionZ, MaxDimensionZ,
                ReservedStatus
            )

            # Build the query string
            query_string = '&'.join([
                f'{k}={v}' for k, v in filter_params.items()
            ])
            endpoint = '/components'
            if query_string:
                endpoint += f'?{query_string}'

            # Generate human-readable filter description
            filter_description = self.generate_filter_description(
                filter_params
            )

            self.Component.Message = (
                'Fetching filtered components (with cache)...'
            )

            # Create cache key based on filter parameters
            cache_key = (f'filtered:{query_string}' if query_string
                         else 'filtered:all')
            # Make cached request to fetch filtered components
            response = auth_core.cached_get(endpoint, cache_key, filter_params)

            if response.status_code == 200:
                # Successfully fetched components
                json_comps = response.json()
                component_count = len(json_comps)

                # Show filter info in message
                filter_msg = f'Found {component_count} components (cached).'

                self.Component.Message = filter_msg
                self._addRemark(
                    f'Successfully fetched {component_count} components '
                    f'with applied filters'
                )

                # Set up output trees and results tuple
                FilterDescription = Grasshopper.DataTree[System.Object]()
                ComponentData = Grasshopper.DataTree[System.Object]()
                __Results = (FilterDescription, ComponentData)

                # Loop over all components and add them to the data tree
                for i, json_comp in enumerate(json_comps):
                    # Create datatree path
                    ghp = Grasshopper.Kernel.Data.GH_Path(0, i)
                    # Add component data to the datatree
                    ComponentData.Add(json.dumps(json_comp), ghp)

                # Add filter description to the filter query output
                FilterDescription.Add(
                    filter_description,
                    Grasshopper.Kernel.Data.GH_Path(0)
                )

                return __Results

            elif response.status_code == 401:
                msg = 'Authentication failed. Please sign in again.'
                self._addError(msg)
                self.Component.Message = msg

            elif response.status_code == 403:
                msg = 'Access denied. Insufficient permissions.'
                self._addError(msg)
                self.Component.Message = msg

            elif response.status_code == 500:
                msg = 'Server error. Please try again later.'
                self._addWarning(msg)
                self.Component.Message = msg

            else:
                msg = (f'Request failed with status code: '
                       f'{response.status_code}')
                self._addError(msg)
                self.Component.Message = msg

        except requests.exceptions.ConnectionError as e:
            msg = 'Cannot connect to server. Please check your connection.'
            self._addError(msg + f'\nFull Error: {str(e)}')
            self.Component.Message = msg

        except requests.exceptions.Timeout as e:
            msg = 'Request timeout. Server may be slow.'
            self._addError(msg + f'\nFull Error: {str(e)}')
            self.Component.Message = msg

        except requests.exceptions.RequestException as e:
            msg = f'Request error: {str(e)}'
            self._addError(msg)
            self.Component.Message = msg

        except Exception as e:
            msg = f'Unexpected error: {str(e)}'
            self._addError(msg)
            self.Component.Message = msg

        # Return empty results if there was an error
        ComponentData = Grasshopper.DataTree[System.Object]()
        FilterDescription = Grasshopper.DataTree[System.Object]()
        __Results = (FilterDescription, ComponentData)
        return __Results
# ---------- end fetchfilteredcomponents ----------
panel = Panel(fetchfilteredcomponents.FilterDescription)
componentdata = Data(fetchfilteredcomponents.ComponentData)

# Step 2.1
# comments & notes: Optional: Offset the design shapes, making the "demanded" geometry larger.
# 
# This can increase the chances of finding components that are large enough to fit the entire cell.
number_slider = Slider(0, range=0..500)
designshapes_2 = Data(designshapes)
offset = OffsetCurve(Curve=designshapes_2, Distance=number_slider, Corners=1)  # -> flatten(Curve)
designshapes_offset = Data(offset)

# Step 2.2
# comments & notes: Compute the radial signature for the design shapes.
# 
# Algorithmically, this is exactly the same as the process that runs on the server and pre-computes this signature for the components in the catalog.
resolution = Slider(64, range=0..100)
designshapes_3 = Data(designshapes_offset)
radialsignature = RadialSignature(Curves=designshapes_3, Resolution=resolution)  # -> Distances, Tangents, IntersectionPoints, Rays, RestPositionCurve, RestPositionFrame, RestPositionAngle, RestPositionTransform; inputs Curves: list, Resolution: Int32, RestPositionAlign: Boolean, NumAngles: Int32
# ---------- radialsignature: Python ----------
#! python3
# -*- coding: utf-8 -*-
# venv: DDU_CSC
print('ENV OK!')
# r: charset_normalizer
# r: requests
# r: numpy
# r: scipy
# r: scikit-learn
# r: robust-laplacian
# r: potpourri3d

# PYTHON STANDARD LIBRARY IMPORTS ---------------------------------------------

# THIRD PARTY LIBRARY IMPORTS -------------------------------------------------
import numpy as np  # NOQA

# RHINO AND GH RELATED IMPORTS ------------------------------------------------
import System  # NOQA
import Grasshopper  # NOQA
import Rhino  # NOQA

# GHENV COMPONENT SETTINGS ----------------------------------------------------
ghenv.Component.Name = 'RadialSignature'  # NOQA
ghenv.Component.NickName = 'RadialSignature'  # NOQA
ghenv.Component.Category = 'DDU_CSC'  # NOQA
ghenv.Component.SubCategory = '7 Geometry Tools'  # NOQA
ghenv.Component.Description = (  # NOQA
    'Radial shape signature for planar boundary curves: rotates each curve '
    'into its canonical rest position (min-bbox-edge orientation), casts '
    'N evenly spaced rays from the centroid, and returns the distance to '
    'the first boundary intersection together with the boundary tangent '
    'at that intersection. Mirrors the backend `radial_signature` module.'
)


# -----------------------------------------------------------------------------
# PURE GEOMETRY HELPERS (port of apps/descriptors/radial_signature.py)
# -----------------------------------------------------------------------------
# Kept as module-level functions so they can be unit-tested / reused without
# the Grasshopper component shell, and so they stay numerically identical to
# the backend reference implementation.

_COINCIDENT_EPS: float = 1e-9
_DEFAULT_REST_ANGLES: int = 180


def _as_profile_array(profile) -> np.ndarray:
    """Validate and return an (M, 2) float array of profile points."""
    P = np.asarray(profile, dtype=np.float64)
    if P.ndim != 2 or P.shape[1] != 2:
        raise ValueError(
            f'profile must be a sequence of [x, y] pairs, got shape {P.shape}'
        )
    if len(P) < 3:
        raise ValueError(
            f'profile must have at least 3 points, got {len(P)}'
        )
    # Drop a duplicate closing vertex if present; the polyline is always
    # treated as an implicit closed polygon.
    if np.allclose(P[0], P[-1]):
        P = P[:-1]
        if len(P) < 3:
            raise ValueError(
                'profile collapses to fewer than 3 unique points'
            )
    return P


def _polygon_centroid_2d(profile: np.ndarray) -> np.ndarray:
    """Shoelace area-weighted centroid of a closed 2D polygon."""
    x, y = profile[:, 0], profile[:, 1]
    xn = np.roll(x, -1)
    yn = np.roll(y, -1)
    cross = x * yn - xn * y
    area2 = cross.sum()
    if abs(area2) < _COINCIDENT_EPS:
        return profile.mean(axis=0)
    cx = ((x + xn) * cross).sum() / (3.0 * area2)
    cy = ((y + yn) * cross).sum() / (3.0 * area2)
    return np.array([cx, cy], dtype=np.float64)


def _rotation_matrix_2d(angle_rad: float) -> np.ndarray:
    c, s = np.cos(angle_rad), np.sin(angle_rad)
    return np.array([[c, -s], [s, c]], dtype=np.float64)


def _rest_position(profile: np.ndarray,
                   num_angles: int = _DEFAULT_REST_ANGLES):
    """Rotate a planar polygon into its canonical rest orientation.

    Faithful port of the legacy C# `RestPosition` routine: for each of
    ``num_angles`` sample angles in [0, pi), rotate the centered profile and
    measure the absolute distance from the origin to each of the four
    axis-aligned bbox edges (|ymin|, |xmax|, |ymax|, |xmin|). The sample
    that produces the smallest such distance, combined with a 90 degree
    correction indexed by which edge was closest, defines the canonical
    rotation.

    Returns:
        rotated: (M, 2) rotated & centered profile
        centroid: (2,) centroid that was subtracted from the input
        angle_deg: rotation applied to the centered profile, degrees
    """
    if num_angles < 1:
        raise ValueError(f'num_angles must be >= 1, got {num_angles}')

    centroid = _polygon_centroid_2d(profile)
    centered = profile - centroid

    step_deg = 180.0 / num_angles
    min_edge_distances = np.empty(num_angles, dtype=np.float64)
    min_edge_corners = np.empty(num_angles, dtype=np.int64)
    for i in range(num_angles):
        ang_rad = np.deg2rad(i * step_deg)
        R = _rotation_matrix_2d(ang_rad)
        Q = centered @ R.T
        xmin, ymin = Q.min(axis=0)
        xmax, ymax = Q.max(axis=0)
        edges = np.array([abs(ymin), abs(xmax), abs(ymax), abs(xmin)])
        j = int(np.argmin(edges))
        min_edge_distances[i] = edges[j]
        min_edge_corners[i] = j

    best_sample = int(np.argmin(min_edge_distances))
    corner = int(min_edge_corners[best_sample])
    angle_deg = -(corner * 90.0) + best_sample * step_deg
    angle_rad = np.deg2rad(angle_deg)
    R_final = _rotation_matrix_2d(angle_rad)
    rotated = centered @ R_final.T
    return rotated, centroid, float(angle_deg)


def _ray_polyline_distances_and_tangents(profile: np.ndarray,
                                         directions: np.ndarray):
    """For each ray, return (distance, unit tangent) of the first boundary hit.

    Rays originate at (0, 0). Segments are the closed polygon edges
    p_i -> p_(i+1 mod M). Returns NaN where no forward hit exists.
    """
    A = profile                       # (M, 2) segment starts
    B = np.roll(profile, -1, axis=0)  # (M, 2) segment ends
    D = B - A                         # (M, 2) segment vectors

    seg_len = np.linalg.norm(D, axis=1)
    valid_seg = seg_len > _COINCIDENT_EPS
    T = np.full_like(D, np.nan)
    T[valid_seg] = D[valid_seg] / seg_len[valid_seg, None]

    R = directions  # (N, 2)
    # denom[n, m] = R[n] x D[m]
    denom = R[:, 0:1] * D[None, :, 1] - R[:, 1:2] * D[None, :, 0]
    A_cross_D = A[:, 0] * D[:, 1] - A[:, 1] * D[:, 0]
    A_cross_R = (A[None, :, 0] * R[:, 1:2]
                 - A[None, :, 1] * R[:, 0:1])

    safe = (np.abs(denom) > _COINCIDENT_EPS) & valid_seg[None, :]
    denom_safe = np.where(safe, denom, 1.0)

    t = A_cross_D[None, :] / denom_safe
    s = A_cross_R / denom_safe

    hit = (
        safe
        & (t >= 0.0)
        & (s >= -_COINCIDENT_EPS)
        & (s <= 1.0 + _COINCIDENT_EPS)
    )

    t_masked = np.where(hit, t, np.inf)
    best_seg = np.argmin(t_masked, axis=1)
    best_t = t_masked[np.arange(len(R)), best_seg]

    miss = ~np.isfinite(best_t)
    distances = np.where(miss, np.nan, best_t)
    tangents = T[best_seg]
    tangents[miss] = np.nan
    return distances, tangents


def _compute_radial_signature(profile, num_rays: int,
                              rest_align: bool = True,
                              num_rest_angles: int = _DEFAULT_REST_ANGLES):
    """Compute distances & tangents for one polygon profile.

    Returns:
        distances: (N,) ndarray
        tangents: (N, 2) ndarray
        centroid: (2,) ndarray (the one that was subtracted)
        angle_deg: float rotation applied to reach rest (0.0 if not aligned)
    """
    if num_rays < 3:
        raise ValueError(f'num_rays must be >= 3, got {num_rays}')

    P = _as_profile_array(profile)
    if rest_align:
        P_rest, centroid, angle_deg = _rest_position(
            P, num_angles=num_rest_angles)
    else:
        centroid = _polygon_centroid_2d(P)
        P_rest = P - centroid
        angle_deg = 0.0

    angles = np.arange(num_rays) * (2.0 * np.pi / num_rays)
    directions = np.column_stack([np.cos(angles), np.sin(angles)])
    distances, tangents = _ray_polyline_distances_and_tangents(
        P_rest, directions)
    return distances, tangents, centroid, angle_deg


class CSC_RadialSignature(Grasshopper.Kernel.GH_ScriptInstance):
    """
    Author: Max Benjamin Eschenbach
    License: MIT License
    Version: 260423
    """

    def __init__(self):
        """Initialize this component and set component parameters."""
        super().__init__()
        self.Component = ghenv.Component  # NOQA
        self.InputParams = self.Component.Params.Input
        self.OutputParams = self.Component.Params.Output

    def _addRemark(self, msg: str = ''):
        rml = self.Component.RuntimeMessageLevel.Remark
        self.AddRuntimeMessage(rml, msg)

    def _addWarning(self, msg: str = ''):
        rml = self.Component.RuntimeMessageLevel.Warning
        self.AddRuntimeMessage(rml, msg)

    def _addError(self, msg: str = ''):
        rml = self.Component.RuntimeMessageLevel.Error
        self.AddRuntimeMessage(rml, msg)

    def BeforeRunScript(self):
        """Describe inputs & outputs."""
        self.InputParams[0].Description = (
            'Closed planar boundary curve(s) to describe. Polylines are '
            'used verbatim; other curves are approximated to polylines '
            'using the document tolerance.'
        )
        self.InputParams[1].Description = (
            'Number of rays cast from the centroid. Default 64. '
            'Must be >= 3.'
        )
        self.InputParams[2].Description = (
            'If True (default), rotate each profile into its canonical '
            'rest position (minimum bbox edge distance) before ray '
            'casting. If False, use the curve as-is (still centered).'
        )
        self.InputParams[3].Description = (
            'Number of rotation samples used for rest-position search '
            'over [0, pi). Default 180 (1 degree steps). Must be >= 1.'
        )
        # Output descriptions -- skip the hidden "out" param if present.
        i = 1 if self.OutputParams[0].Name == 'out' else 0
        self.OutputParams[0 + i].Description = (
            'Tree of distances from the centroid to the first boundary '
            'intersection for each ray. One branch per input curve.'
        )
        self.OutputParams[1 + i].Description = (
            'Tree of unit tangent vectors of the boundary at each ray '
            'hit, expressed in world coordinates on the curve plane.'
        )
        self.OutputParams[2 + i].Description = (
            'Tree of intersection points in world coordinates, one '
            'branch per input curve. Useful for visualising the signature.'
        )
        self.OutputParams[3 + i].Description = (
            'Tree of rays (as Lines) in world coordinates, one branch '
            'per input curve. Useful for visualisation.'
        )
        self.OutputParams[4 + i].Description = (
            'Input curves transformed into their rest position: centroid '
            'at world origin, canonical rest axes aligned with World XY. '
            'This is exactly the geometry the signature is computed on.'
        )
        self.OutputParams[5 + i].Description = (
            'List of rest-position planes, one per input curve. Origin '
            'is the centroid on the input curve plane; X/Y are aligned '
            'with the canonical orientation used by the signature.'
        )
        self.OutputParams[6 + i].Description = (
            'List of rotation angles (degrees) applied to reach rest '
            'position, one per input curve.'
        )
        self.OutputParams[7 + i].Description = (
            'Transform mapping world coordinates into the rest frame '
            '(origin at centroid; World XY only if RestPositionAlign is '
            'True). Apply to any other geometry to see it in the same '
            'frame as the rest curve.'
        )

    def _curve_to_polyline_and_plane(self, curve):
        """Return (polyline_points_3d, curve_plane) or (None, None).

        Falls back to ``Plane.WorldXY`` for non-planar or degenerate curves
        and adds a warning.
        """
        if curve is None:
            return None, None

        tol = Rhino.RhinoDoc.ActiveDoc.ModelAbsoluteTolerance
        if tol is None or tol <= 0.0:
            tol = 1e-3

        # Fetch an actual Polyline -- exact for polylines / polygons, an
        # approximation otherwise (angle-based to preserve curvature).
        ok, pl = curve.TryGetPolyline()
        if not ok or pl is None or pl.Count < 3:
            pc = curve.ToPolyline(
                0,           # mainSegmentCount (0 = auto)
                0,           # subSegmentCount
                0.1,         # maxAngleRadians (~5.7 deg chord deviation)
                0.0,         # maxChordLengthRatio
                0.0,         # maxAspectRatio
                tol,         # tolerance
                0.0,         # minEdgeLength
                0.0,         # maxEdgeLength
                True,        # keepStartPoint
            )
            if pc is None:
                return None, None
            pl = pc.ToPolyline()
            if pl is None or pl.Count < 3:
                return None, None

        ok_plane, plane = curve.TryGetPlane(tol)
        if not ok_plane:
            self._addWarning(
                'Curve is not planar within tolerance; falling back to '
                'World XY. Consider supplying a planar curve.'
            )
            plane = Rhino.Geometry.Plane.WorldXY

        return pl, plane

    def _project_polyline_to_plane(self, polyline, plane):
        """Project polyline vertices to the curve's plane. Returns (M, 2)."""
        xform = Rhino.Geometry.Transform.PlaneToPlane(
            plane, Rhino.Geometry.Plane.WorldXY)
        pts_2d = []
        for p in polyline:
            q = Rhino.Geometry.Point3d(p)
            q.Transform(xform)
            pts_2d.append([q.X, q.Y])
        return np.asarray(pts_2d, dtype=np.float64)

    def _rest_frame_in_world(self, plane, centroid_xy, rest_angle_deg):
        """Build a Rhino.Geometry.Plane placed at the rest-position origin.

        The plane's origin is the 3D centroid; its X/Y axes correspond to
        the rest-aligned 2D frame rotated back into world coordinates.
        """
        # Rest frame in curve-plane coordinates: origin is the centroid,
        # axes are rotated by ``rest_angle_deg`` around +Z relative to the
        # curve plane. Since a point ``q`` in the original 2D frame maps
        # to ``R * (q - c)`` in the rest frame, the inverse mapping back
        # to the curve plane is a rotation by ``-rest_angle_deg``.
        theta = np.deg2rad(-rest_angle_deg)
        c, s = float(np.cos(theta)), float(np.sin(theta))
        x_axis_xy = np.array([c, s, 0.0])
        y_axis_xy = np.array([-s, c, 0.0])

        origin_xy = Rhino.Geometry.Point3d(
            float(centroid_xy[0]), float(centroid_xy[1]), 0.0)
        xform = Rhino.Geometry.Transform.PlaneToPlane(
            Rhino.Geometry.Plane.WorldXY, plane)
        origin_3d = Rhino.Geometry.Point3d(origin_xy)
        origin_3d.Transform(xform)

        x_vec_3d = Rhino.Geometry.Vector3d(*x_axis_xy)
        y_vec_3d = Rhino.Geometry.Vector3d(*y_axis_xy)
        x_vec_3d.Transform(xform)
        y_vec_3d.Transform(xform)

        return Rhino.Geometry.Plane(origin_3d, x_vec_3d, y_vec_3d)

    def _xy_point_to_world(self, xform_to_plane, x, y):
        """Map a point in the curve-plane XY frame to world coordinates."""
        p = Rhino.Geometry.Point3d(float(x), float(y), 0.0)
        p.Transform(xform_to_plane)
        return p

    def _xy_vector_to_world(self, xform_to_plane, vx, vy):
        """Map a vector in the curve-plane XY frame to world coordinates."""
        v = Rhino.Geometry.Vector3d(float(vx), float(vy), 0.0)
        v.Transform(xform_to_plane)
        return v

    def RunScript(self,
            Curves: System.Collections.Generic.List[object],
            Resolution: int,
            RestPositionAlign: bool,
            NumAngles: int):
        # Keep list-access behavior by default. If the current input list
        # (which may represent one incoming branch) has multiple curves,
        # switch to explicit tree output keyed by run count + item index.
        multi_input = bool(Curves) and len(Curves) > 1
        if multi_input:
            Distances = Grasshopper.DataTree[System.Object]()
            Tangents = Grasshopper.DataTree[System.Object]()
            IntersectionPoints = Grasshopper.DataTree[System.Object]()
            Rays = Grasshopper.DataTree[System.Object]()
            RestPositionCurve = Grasshopper.DataTree[System.Object]()
            RestPositionFrame = Grasshopper.DataTree[System.Object]()
            RestPositionAngle = Grasshopper.DataTree[System.Object]()
            RestPositionTransform = Grasshopper.DataTree[System.Object]()
        else:
            Distances = []
            Tangents = []
            IntersectionPoints = []
            Rays = []
            RestPositionCurve = []
            RestPositionFrame = []
            RestPositionAngle = []
            RestPositionTransform = []
        __Results = (
            Distances, Tangents, IntersectionPoints, Rays,
            RestPositionCurve, RestPositionFrame,
            RestPositionAngle, RestPositionTransform,
        )

        # Defaults
        if Resolution is None:
            Resolution = 64
        if RestPositionAlign is None:
            RestPositionAlign = True
        if NumAngles is None:
            NumAngles = _DEFAULT_REST_ANGLES

        # Input validation
        if not Curves:
            msg = 'No curves provided'
            self._addWarning(msg)
            self.Component.Message = msg
            return __Results

        try:
            Resolution = int(Resolution)
        except (TypeError, ValueError):
            self._addError(
                f'Resolution must be an integer, got {Resolution!r}')
            return __Results
        if Resolution < 3:
            self._addError(f'Resolution must be >= 3, got {Resolution}')
            return __Results

        try:
            NumAngles = int(NumAngles)
        except (TypeError, ValueError):
            self._addError(
                f'NumAngles must be an integer, got '
                f'{NumAngles!r}')
            return __Results
        if NumAngles < 1:
            self._addError(
                f'NumAngles must be >= 1, got '
                f'{NumAngles}')
            return __Results

        self.Component.Message = f'N={Resolution}'

        successes = 0
        rc = self.Component.RunCount - 1
        for branch_idx, curve in enumerate(Curves):
            path = Grasshopper.Kernel.Data.GH_Path(rc, branch_idx)

            polyline, plane = self._curve_to_polyline_and_plane(curve)
            if polyline is None or plane is None:
                self._addWarning(
                    f'Curve #{branch_idx}: could not build polyline; skipped')
                continue

            try:
                profile_xy = self._project_polyline_to_plane(polyline, plane)
                distances, tangents, centroid_xy, angle_deg = (
                    _compute_radial_signature(
                        profile_xy,
                        num_rays=Resolution,
                        rest_align=bool(RestPositionAlign),
                        num_rest_angles=NumAngles,
                    )
                )
            except ValueError as exc:
                self._addWarning(
                    f'Curve #{branch_idx}: {exc}; skipped')
                continue

            if np.any(np.isnan(distances)):
                missed = int(np.isnan(distances).sum())
                self._addWarning(
                    f'Curve #{branch_idx}: {missed}/{Resolution} rays did '
                    f'not hit the boundary (centroid outside profile or '
                    f'non-simple polygon); skipped'
                )
                continue

            # Map results back to world coordinates.
            # In the rest frame: hit point = t * (cos a, sin a);
            # tangent = (tx, ty). The rest frame itself lives on the
            # curve plane at ``centroid_xy``, rotated by rest_angle_deg.
            # Build a combined transform 2D(rest) -> 2D(curve) -> world.
            rest_frame_curve = Rhino.Geometry.Plane(
                Rhino.Geometry.Point3d(
                    float(centroid_xy[0]), float(centroid_xy[1]), 0.0),
                Rhino.Geometry.Vector3d.XAxis,
                Rhino.Geometry.Vector3d.YAxis,
            )
            # Rotate the rest plane's X/Y by -rest_angle_deg so that a
            # point expressed in the rest frame maps back to the same
            # location in the curve-plane XY frame.
            theta = np.deg2rad(-angle_deg)
            c, s = float(np.cos(theta)), float(np.sin(theta))
            rest_x = Rhino.Geometry.Vector3d(c, s, 0.0)
            rest_y = Rhino.Geometry.Vector3d(-s, c, 0.0)
            rest_frame_curve = Rhino.Geometry.Plane(
                rest_frame_curve.Origin, rest_x, rest_y)

            xform_curve_to_world = Rhino.Geometry.Transform.PlaneToPlane(
                Rhino.Geometry.Plane.WorldXY, plane)

            # Combined mapper: 2D rest frame -> 3D world.
            def to_world_point(xr, yr):
                # Into curve XY frame first...
                px = rest_frame_curve.Origin.X + c * xr - s * yr
                py = rest_frame_curve.Origin.Y + s * xr + c * yr
                # ...then lift to world via the curve plane.
                p = Rhino.Geometry.Point3d(float(px), float(py), 0.0)
                p.Transform(xform_curve_to_world)
                return p

            def to_world_vector(vxr, vyr):
                vx = c * vxr - s * vyr
                vy = s * vxr + c * vyr
                v = Rhino.Geometry.Vector3d(float(vx), float(vy), 0.0)
                v.Transform(xform_curve_to_world)
                return v

            # Rays in the rest frame: origin (0, 0), direction (cos, sin).
            ray_angles = np.arange(Resolution) * (2.0 * np.pi / Resolution)
            ray_dirs = np.column_stack(
                [np.cos(ray_angles), np.sin(ray_angles)])

            world_origin = to_world_point(0.0, 0.0)

            distance_values = []
            tangent_values = []
            hit_points = []
            ray_lines = []
            for k in range(Resolution):
                t = float(distances[k])
                dx, dy = float(ray_dirs[k, 0]), float(ray_dirs[k, 1])
                hit_world = to_world_point(t * dx, t * dy)
                tx, ty = float(tangents[k, 0]), float(tangents[k, 1])
                tan_world = to_world_vector(tx, ty)

                distance_values.append(t)
                tangent_values.append(tan_world)
                hit_points.append(hit_world)
                ray_lines.append(
                    Rhino.Geometry.Line(world_origin, hit_world))

            if multi_input:
                Distances.AddRange(distance_values, path)
                Tangents.AddRange(tangent_values, path)
                IntersectionPoints.AddRange(hit_points, path)
                Rays.AddRange(ray_lines, path)
            else:
                Distances.extend(distance_values)
                Tangents.extend(tangent_values)
                IntersectionPoints.extend(hit_points)
                Rays.extend(ray_lines)

            # Rest-position frame expressed in world coordinates: origin
            # at the 3D centroid on the curve plane, X/Y axes aligned with
            # the canonical orientation picked by the rest-position search.
            rest_frame_world = self._rest_frame_in_world(
                plane, centroid_xy, angle_deg)

            # World -> rest-frame transform. Applying this to the input
            # curve moves it so its centroid sits at the world origin and
            # its rest-aligned axes coincide with the World XY axes -- i.e.
            # exactly what the signature "sees" internally.
            if RestPositionAlign:
                # Full rest-position transform: center + canonical orientation
                # into World XY.
                xform_world_to_rest = Rhino.Geometry.Transform.PlaneToPlane(
                    rest_frame_world, Rhino.Geometry.Plane.WorldXY)
            else:
                # No rest-position rotation: keep the curve orientation as-is
                # in world coordinates and only center it at the origin.
                xform_world_to_rest = Rhino.Geometry.Transform.Translation(
                    Rhino.Geometry.Vector3d(
                        -rest_frame_world.Origin.X,
                        -rest_frame_world.Origin.Y,
                        -rest_frame_world.Origin.Z,
                    )
                )
            rest_curve = curve.DuplicateCurve()
            rest_curve.Transform(xform_world_to_rest)

            if multi_input:
                RestPositionCurve.Add(rest_curve, path)
                RestPositionFrame.Add(rest_frame_world, path)
                RestPositionAngle.Add(float(angle_deg), path)
                RestPositionTransform.Add(xform_world_to_rest, path)
            else:
                RestPositionCurve.append(rest_curve)
                RestPositionFrame.append(rest_frame_world)
                RestPositionAngle.append(float(angle_deg))
                RestPositionTransform.append(xform_world_to_rest)

            successes += 1

        if successes == 0:
            self._addWarning('No curves produced a valid signature')
            self.Component.Message = 'no output'
        else:
            self.Component.Message = (
                f'N = {Resolution}')
            self._addRemark(
                f'Computed radial signature for {successes} curve(s) '
                f'at resolution N={Resolution}'
            )

        return __Results
# ---------- end radialsignature ----------
designshapes_restpositiontransform = Data(radialsignature.RestPositionTransform)
designshapes_distances = Data(radialsignature.Distances)
designshapes_tangents = Data(radialsignature.Tangents)

# Step 3.3
# comments & notes: Disassemble the components to get the primitive geometry
componentdata_2 = Data(componentdata)
disassemblecomponent = DisassembleComponent(ComponentData=componentdata_2)  # -> ID, Name, Type, Material, Color, Location, BoundingBox, PCAFrame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; inputs ComponentData: tree of String
# ---------- disassemblecomponent: Python ----------
#! python3
# -*- coding: utf-8 -*-
# venv: DDU_CSC
print('ENV OK!')
# r: charset_normalizer
# r: requests
# r: numpy
# r: scipy
# r: scikit-learn
# r: robust-laplacian
# r: potpourri3d

# PYTHON STANDARD LIBRARY IMPORTS ---------------------------------------------
import json  # NOQA

# RHINO AND GH RELATED IMPORTS ------------------------------------------------
import System  # NOQA
import Rhino  # NOQA
import Grasshopper  # NOQA

# GHENV COMPONENT SETTINGS ----------------------------------------------------
ghenv.Component.Name = 'DisassembleComponent'  # NOQA
ghenv.Component.NickName = 'DisassembleComponent'  # NOQA
ghenv.Component.Category = 'DDU_CSC'  # NOQA
ghenv.Component.SubCategory = '3 Component Operations'  # NOQA
ghenv.Component.Description = (  # NOQA
    'Parses component data (JSON) and outputs individual fields as '
    'Grasshopper-native types. Reconstructs geometry, bounding boxes, '
    'PCA frames, and metadata from component JSON.'
)


class CSC_DisassembleComponent(Grasshopper.Kernel.GH_ScriptInstance):
    """
    Author: Max Benjamin Eschenbach
    License: MIT License
    Version: 260426.1
    """

    def __init__(self):
        """Initialize this component and set component parameters."""
        super().__init__()
        # initialize props
        self.Component = ghenv.Component  # NOQA
        self.InputParams = self.Component.Params.Input
        self.OutputParams = self.Component.Params.Output

    def _addRemark(self, msg: str = ''):
        """Add a remark message to the component."""
        rml = self.Component.RuntimeMessageLevel.Remark
        self.AddRuntimeMessage(rml, msg)

    def _addWarning(self, msg: str = ''):
        """Add a warning message to the component."""
        rml = self.Component.RuntimeMessageLevel.Warning
        self.AddRuntimeMessage(rml, msg)

    def _addError(self, msg: str = ''):
        """Add an error message to the component."""
        rml = self.Component.RuntimeMessageLevel.Error
        self.AddRuntimeMessage(rml, msg)

    def BeforeRunScript(self):
        """Perform some setup actions."""
        # Initialize input param descriptions
        self.InputParams[0].Description = (
            'The ComponentData that was fetched from the server as JSON.'
        )
        # Initialize output param descriptions
        i = 0
        if self.OutputParams[0].Name == 'out':
            i += 1
        self.OutputParams[0+i].Description = (
            'Component ID (GUID)'
        )
        self.OutputParams[1+i].Description = (
            'Component name (e.g. My Component 01)'
        )
        self.OutputParams[2+i].Description = (
            'Component type (panel, beam, slab, etc.)'
        )
        self.OutputParams[3+i].Description = (
            'Component material'
        )
        self.OutputParams[4+i].Description = (
            'Component color as System.Drawing.Color'
        )
        self.OutputParams[5+i].Description = (
            'Component location as Point3d (X=latitude, Y=longitude, Z=0)'
        )
        self.OutputParams[6+i].Description = (
            'Component bounding box as Rhino.Geometry.BoundingBox'
        )
        self.OutputParams[7+i].Description = (
            'PCA frame at world origin as Rhino.Geometry.Plane'
        )
        self.OutputParams[8+i].Description = (
            'Component descriptors/metadata as JSON string'
        )
        self.OutputParams[9+i].Description = (
            'Rhino geometry objects (extrusion, meshes, polyline)'
        )
        self.OutputParams[10+i].Description = (
            'Marker points as list of Point3d objects'
        )
        self.OutputParams[11+i].Description = (
            'Component attributes as JSON string'
        )
        self.OutputParams[12+i].Description = (
            'Component condition grade (0=destroyed/retired, 1=poor, '
            '2=average, 3=good)'
        )
        self.OutputParams[13+i].Description = (
            'Component manufacturing date as ISO-8601 UTC timestamp'
        )
        self.OutputParams[14+i].Description = (
            'Precision qualifier for ManufacturedAt (exact, month, year, '
            'unknown)'
        )
        self.OutputParams[15+i].Description = (
            'Component salvage source (e.g. building name, site)'
        )
        self.OutputParams[16+i].Description = (
            'Component salvage date as ISO-8601 UTC timestamp'
        )
        self.OutputParams[17+i].Description = (
            'Parent component ID (GUID) this component was derived from'
        )

    def ComponentExtrusionProfile(
            self,
            json_comp: dict) -> Rhino.Geometry.Polyline:
        pl = Rhino.Geometry.Polyline()
        pts = [Rhino.Geometry.Point3d(pt[0], pt[1], 0.0)
               for pt in json_comp['geometry']['extrusion']['profile']]
        pl.AddRange(pts)
        return pl

    def ComponentExtrusion(
            self,
            json_comp: dict) -> Rhino.Geometry.Extrusion:
        pl = Rhino.Geometry.Polyline()
        pts = [Rhino.Geometry.Point3d(pt[0], pt[1], 0.0)
               for pt in json_comp['geometry']['extrusion']['profile']]
        pl.AddRange(pts)
        cxt = Rhino.Geometry.Extrusion.Create(
            pl.ToPolylineCurve(),
            Rhino.Geometry.Plane.WorldXY,
            json_comp['geometry']['extrusion']['height'],
            True)
        # move extrusion downwards half material
        # thickness to center it at the origin
        cxt.Translate(Rhino.Geometry.Vector3d(
            0, 0, json_comp['geometry']['extrusion']['height'] * -0.5))
        return cxt

    def ComponentMeshes(self, json_comp: dict) -> list[Rhino.Geometry.Mesh]:
        """Create multiple meshes from geometry.meshes field."""
        meshes = []
        for i, mesh_data in enumerate(json_comp['geometry']['meshes']):
            mesh = Rhino.Geometry.Mesh()
            vl = mesh_data['v']
            fl = mesh_data['f']
            [mesh.Vertices.Add(*v) for v in vl]
            [mesh.Faces.AddFace(*f) for f in fl]
            # Try to get mesh-specific colors first
            try:
                cl = mesh_data['c']
                [mesh.VertexColors.Add(
                    System.Drawing.Color.FromArgb(*c)) for c in cl]
            except KeyError:
                # Fallback: use component color for all vertices
                try:
                    component_color = System.Drawing.Color.FromArgb(
                        255, *json_comp['color'])
                    for _ in range(len(vl)):
                        mesh.VertexColors.Add(component_color)
                except (KeyError, TypeError):
                    # If even component color fails, use a default gray
                    default_color = System.Drawing.Color.Gray
                    for _ in range(len(vl)):
                        mesh.VertexColors.Add(default_color)
                    self._addWarning(
                        f'Mesh {i} in component {json_comp["_id"]} '
                        f'using default gray color')
            mesh.RebuildNormals()
            mesh.UnifyNormals()
            mesh.Compact()
            meshes.append(mesh)
        return meshes

    def ComponentColor(self, json_comp: dict) -> System.Drawing.Color:
        return System.Drawing.Color.FromArgb(255, *json_comp['color'])

    def ComponentBoundingBox(
            self,
            json_comp: dict) -> Rhino.Geometry.BoundingBox:
        xtx = json_comp['bbx'][0]
        xty = json_comp['bbx'][1]
        xtz = json_comp['bbx'][2]

        # Get bbx_origin (center of bounding box in PCA space)
        bbx_origin = json_comp.get('bbx_origin', [0.0, 0.0, 0.0])

        # Create bounding box at bbx_origin in PCA space
        bbx = Rhino.Geometry.BoundingBox(
            bbx_origin[0] - xtx * 0.5,
            bbx_origin[1] - xty * 0.5,
            bbx_origin[2] - xtz * 0.5,
            bbx_origin[0] + xtx * 0.5,
            bbx_origin[1] + xty * 0.5,
            bbx_origin[2] + xtz * 0.5
        )

        # Convert bounding box to Box for transformation
        bbx = Rhino.Geometry.Box(bbx)

        # Transform from PCA space back to original component space
        try:
            pca_frame = json_comp.get('pca_frame', {})
            if pca_frame:
                # Create PCA frame plane at world origin
                pca_origin = Rhino.Geometry.Point3d(
                    *pca_frame.get('o', [0, 0, 0]))
                pca_x = Rhino.Geometry.Vector3d(
                    *pca_frame.get('x', [1, 0, 0]))
                pca_y = Rhino.Geometry.Vector3d(
                    *pca_frame.get('y', [0, 1, 0]))

                pca_plane = Rhino.Geometry.Plane(pca_origin, pca_x, pca_y)

                # Create forward transform (from PCA space to original space)
                pca_transform = (
                    Rhino.Geometry.Transform.PlaneToPlane(
                        Rhino.Geometry.Plane.WorldXY, pca_plane))

                bbx.Transform(pca_transform)

        except (KeyError, TypeError, ValueError) as e:
            # If PCA frame is missing or invalid, use bounding box as-is
            self._addWarning(f'Could not apply PCA frame transform: {str(e)}')

        return bbx

    def ComponentPCAPlane(self, json_comp: dict) -> Rhino.Geometry.Plane:
        """Get PCA plane at world origin from component data."""
        try:
            pca_frame = json_comp.get('pca_frame', {})
            if pca_frame:
                pca_x = Rhino.Geometry.Vector3d(
                    *pca_frame.get('x', [1, 0, 0]))
                pca_y = Rhino.Geometry.Vector3d(
                    *pca_frame.get('y', [0, 1, 0]))
                return Rhino.Geometry.Plane(
                    Rhino.Geometry.Point3d.Origin, pca_x, pca_y)
            else:
                return Rhino.Geometry.Plane.WorldXY
        except (KeyError, TypeError, ValueError):
            return Rhino.Geometry.Plane.WorldXY

    def RunScript(self, ComponentData: Grasshopper.DataTree[str]):
        # set up output trees and results tuple
        ID = Grasshopper.DataTree[System.Object]()
        Name = Grasshopper.DataTree[System.Object]()
        Type = Grasshopper.DataTree[System.Object]()
        Material = Grasshopper.DataTree[System.Object]()
        Color = Grasshopper.DataTree[System.Object]()
        Location = Grasshopper.DataTree[System.Object]()
        BoundingBox = Grasshopper.DataTree[System.Object]()
        PCAFrame = Grasshopper.DataTree[System.Object]()
        Descriptors = Grasshopper.DataTree[System.Object]()
        PrimitiveGeometry = Grasshopper.DataTree[System.Object]()
        MarkerPoints = Grasshopper.DataTree[System.Object]()
        Attributes = Grasshopper.DataTree[System.Object]()
        Condition = Grasshopper.DataTree[System.Object]()
        ManufacturedAt = Grasshopper.DataTree[System.Object]()
        ManufacturedPrecision = Grasshopper.DataTree[System.Object]()
        SalvageSource = Grasshopper.DataTree[System.Object]()
        SalvagedAt = Grasshopper.DataTree[System.Object]()
        ParentComponent = Grasshopper.DataTree[System.Object]()
        __Results = (
            ID,
            Name,
            Type,
            Material,
            Color,
            Location,
            BoundingBox,
            PCAFrame,
            Descriptors,
            PrimitiveGeometry,
            MarkerPoints,
            Attributes,
            Condition,
            ManufacturedAt,
            ManufacturedPrecision,
            SalvageSource,
            SalvagedAt,
            ParentComponent)
        try:
            # Validate input
            if not ComponentData or ComponentData.DataCount == 0:
                msg = ('Input ComponentData failed to collect Data')
                self._addWarning(msg)
                self.Component.Message = msg
                return __Results

            self.Component.Message = 'Disassembling components...'

            # loop over all branches
            for i in range(ComponentData.BranchCount):
                for j, comp in enumerate(ComponentData.Branches[i]):
                    try:
                        json_comp = json.loads(comp)
                        # create datatree path
                        ghp = ComponentData.Paths[i]
                        # add directly available metadata to the
                        # respective datatrees
                        ID.Add(json_comp['_id'], ghp)
                        Name.Add(json_comp['name'], ghp)
                        Type.Add(json_comp['type'], ghp)
                        Material.Add(json_comp['material'], ghp)

                        # create system color from rgb values
                        color = self.ComponentColor(json_comp)
                        Color.Add(color, ghp)

                        # process location data
                        try:
                            location_data = json_comp.get('location', {})
                            if (location_data and 'lat' in location_data and
                                    'lon' in location_data):
                                location_point = Rhino.Geometry.Point3d(
                                    location_data['lat'],
                                    location_data['lon'],
                                    0.0
                                )
                            else:
                                location_point = Rhino.Geometry.Point3d(
                                    0.0, 0.0, 0.0)
                        except (KeyError, TypeError):
                            location_point = Rhino.Geometry.Point3d(
                                0.0, 0.0, 0.0)
                        Location.Add(location_point, ghp)

                        # process insertion frame
                        try:
                            iframe = json_comp['iframe']
                            iplane = Rhino.Geometry.Plane(
                                Rhino.Geometry.Point3d(*iframe['o']),
                                Rhino.Geometry.Vector3d(*iframe['x']),
                                Rhino.Geometry.Vector3d(*iframe['y']),
                            )
                        except KeyError:
                            iplane = Rhino.Geometry.Plane.WorldXY

                        xform = Rhino.Geometry.Transform.PlaneToPlane(
                            Rhino.Geometry.Plane.WorldXY,
                            iplane)

                        # treat geometry key in a special way because
                        # it may hold multiple geometry types
                        for key in sorted(json_comp['geometry'].keys()):
                            if key == 'extrusion':
                                xtr = self.ComponentExtrusion(json_comp)
                                # transform to iframe
                                xtr.Transform(xform)
                                # set user string
                                xtr.SetUserString('csc_component', comp)
                                # add to datatree
                                PrimitiveGeometry.Add(xtr, ghp)
                            elif key == 'meshes':
                                # Handle multiple meshes
                                meshes = self.ComponentMeshes(json_comp)
                                for i, mesh in enumerate(meshes):
                                    # transform to iframe
                                    mesh.Transform(xform)
                                    # set user string with mesh index
                                    mesh.SetUserString('csc_component', comp)
                                    mesh.SetUserString('csc_mesh_index',
                                                       str(i))
                                    # add to datatree
                                    PrimitiveGeometry.Add(mesh, ghp)
                            else:
                                msg = (f'Missing implementation for geometry '
                                       f'of type \'{key}\'!')
                                self._addWarning(msg)

                        # construct boundingbox
                        bbx = self.ComponentBoundingBox(json_comp)

                        # apply iframe transform
                        bbx.Transform(xform)
                        BoundingBox.Add(bbx, ghp)

                        # get PCA plane at world origin
                        pca_plane = self.ComponentPCAPlane(json_comp)
                        # apply iframe transform to PCA plane
                        pca_plane.Transform(xform)
                        PCAFrame.Add(pca_plane, ghp)

                        # add descriptors
                        try:
                            descriptors = json_comp.get('descriptors', {})
                            Descriptors.Add(json.dumps(descriptors), ghp)
                        except KeyError:
                            # If no descriptors, add empty dict as JSON string
                            Descriptors.Add(json.dumps({}), ghp)

                        # process marker points
                        try:
                            marker_points_data = json_comp.get(
                                'marker_points', [])
                            marker_points_list = []
                            for point_data in marker_points_data:
                                if (isinstance(point_data, list) and
                                        len(point_data) >= 3):
                                    marker_point = Rhino.Geometry.Point3d(
                                        point_data[0],
                                        point_data[1],
                                        point_data[2]
                                    )
                                    # apply iframe transform to marker point
                                    marker_point.Transform(xform)
                                    marker_points_list.append(marker_point)
                        except (KeyError, TypeError, IndexError):
                            # If no marker points or invalid format, add empty
                            # list
                            marker_points_list = []
                        if marker_points_list:
                            MarkerPoints.AddRange(marker_points_list, ghp)

                        # process attributes
                        try:
                            attributes = json_comp.get('attributes', {})
                            Attributes.Add(json.dumps(attributes), ghp)
                        except KeyError:
                            # If no attributes, add empty dict as JSON string
                            Attributes.Add(json.dumps({}), ghp)

                        if json_comp.get('condition') is not None:
                            Condition.Add(json_comp['condition'], ghp)
                        if json_comp.get('manufactured_at') is not None:
                            ManufacturedAt.Add(
                                json_comp['manufactured_at'], ghp)
                        if json_comp.get('manufactured_precision') is not None:
                            ManufacturedPrecision.Add(
                                json_comp['manufactured_precision'], ghp)
                        if json_comp.get('salvage_source') is not None:
                            SalvageSource.Add(json_comp['salvage_source'], ghp)
                        if json_comp.get('salvaged_at') is not None:
                            SalvagedAt.Add(json_comp['salvaged_at'], ghp)
                        if json_comp.get('parent_component') is not None:
                            ParentComponent.Add(
                                json_comp['parent_component'], ghp)

                    except json.JSONDecodeError as e:
                        msg = f'Failed to parse component data: {str(e)}'
                        self._addError(msg)
                    except Exception as e:
                        msg = f'Error processing component: {str(e)}'
                        self._addError(msg)

            # Update success message
            total_components = sum(
                len(branch) for branch in ComponentData.Branches
            )
            self.Component.Message = (
                f'Disassembled {total_components} component(s)'
            )
            self._addRemark(
                f'Successfully disassembled {total_components} components'
            )

            # return output trees
            return __Results

        except Exception as e:
            msg = f'Unexpected error during disassembly: {str(e)}'
            self._addError(msg)
            return __Results
# ---------- end disassemblecomponent ----------
manufacturedprecision = Data(disassemblecomponent.ManufacturedPrecision)
primitivegeometry = Data(disassemblecomponent.PrimitiveGeometry)
parentcomponent = Data(disassemblecomponent.ParentComponent)
manufacturedat = Data(disassemblecomponent.ManufacturedAt)
salvagesource = Data(disassemblecomponent.SalvageSource)
boundingbox = Data(disassemblecomponent.BoundingBox)
markerpoints = Data(disassemblecomponent.MarkerPoints)
descriptors = Data(disassemblecomponent.Descriptors)
salvagedat = Data(disassemblecomponent.SalvagedAt)
pcaframe = Data(disassemblecomponent.PCAFrame)
attributes = Data(disassemblecomponent.Attributes)
condition = Data(disassemblecomponent.Condition)
location = Data(disassemblecomponent.Location)
material_2 = Data(disassemblecomponent.Material)
type_2 = Data(disassemblecomponent.Type)
color = Data(disassemblecomponent.Color)
id = Data(disassemblecomponent.ID)
name = Data(disassemblecomponent.Name)

# Step 3.1
# comments & notes: Get radial shape signature distances with medium (32 rays) resolution.
panel_2 = Panel("radial_distance_64")
componentdata_3 = Data(componentdata)
getdescriptor = GetDescriptor(Input=componentdata_3, DescriptorKey=panel_2)  # -> DescriptorValues; inputs Input: list, DescriptorKey: String
# ---------- getdescriptor: Python ----------
#! python3
# -*- coding: utf-8 -*-
# venv: DDU_CSC
print('ENV OK!')
# r: charset_normalizer
# r: requests
# r: numpy
# r: scipy
# r: scikit-learn
# r: robust-laplacian
# r: potpourri3d

# PYTHON STANDARD LIBRARY IMPORTS ---------------------------------------------
import json  # NOQA

# RHINO AND GH RELATED IMPORTS ------------------------------------------------
import System  # NOQA
import Grasshopper  # NOQA
import Rhino  # NOQA

# GHENV COMPONENT SETTINGS ----------------------------------------------------
ghenv.Component.Name = 'GetDescriptor'  # NOQA
ghenv.Component.NickName = 'GetDescriptor'  # NOQA
ghenv.Component.Category = 'DDU_CSC'  # NOQA
ghenv.Component.SubCategory = '6 Data Tools'  # NOQA
ghenv.Component.Description = (  # NOQA
    'Retrieves a specific descriptor from multiple component_data inputs. '
    'Accepts a list of component_data JSON strings or geometries with '
    'attached component_data. Returns the descriptor values for the specified '
    'key from the descriptors array. Handles single values, lists, and nested '
    'lists by mapping them to appropriate Grasshopper data structures with '
    'input indices as the first path level.'
)


class CSC_GetDescriptor(Grasshopper.Kernel.GH_ScriptInstance):
    """
    Author: Max Benjamin Eschenbach
    License: MIT License
    Version: 251203
    """

    def __init__(self):
        """Initialize this component and set component parameters."""
        super().__init__()
        # initialize props
        self.Component = ghenv.Component  # NOQA
        self.InputParams = self.Component.Params.Input
        self.OutputParams = self.Component.Params.Output

    def _addRemark(self, msg: str = ''):
        """Add a remark message to the component."""
        rml = self.Component.RuntimeMessageLevel.Remark
        self.AddRuntimeMessage(rml, msg)

    def _addWarning(self, msg: str = ''):
        """Add a warning message to the component."""
        rml = self.Component.RuntimeMessageLevel.Warning
        self.AddRuntimeMessage(rml, msg)

    def _addError(self, msg: str = ''):
        """Add an error message to the component."""
        rml = self.Component.RuntimeMessageLevel.Error
        self.AddRuntimeMessage(rml, msg)

    def BeforeRunScript(self):
        """Perform some setup actions."""
        # Set "No type hint"
        self.InputParams[0].TypeHints.Select(System.Object)
        self.Component.VariableParameterMaintenance()
        # Initialize input param descriptions
        self.InputParams[0].Description = (
            'List of component data as JSON strings OR geometries with '
            'attached component_data userdata'
        )
        self.InputParams[1].Description = (
            'Key string to retrieve from the descriptors array in '
            'component_data'
        )
        # Initialize output param descriptions
        i = 0
        if self.OutputParams[0].Name == 'out':
            i += 1
        self.OutputParams[0+i].Description = (
            'Descriptor value for the specified key, or empty if not found'
        )

    def extract_component_data_from_geometry(self, geometry):
        """
        Extract component data from geometry userdata.

        Args:
            geometry: Rhino geometry object with userdata

        Returns:
            Component data dictionary or None
        """
        try:
            if hasattr(geometry, 'GetUserString'):
                userdata = geometry.GetUserString('csc_component')
                if userdata:
                    return json.loads(userdata)
        except Exception as e:
            self._addWarning(f'Could not extract component data: {str(e)}')
        return None

    def get_descriptor_value(self, component_data, descriptor_key):
        """
        Extract descriptor value from component_data using the specified key.

        Args:
            component_data: Dictionary containing component data
            descriptor_key: String key to look for in descriptors

        Returns:
            Descriptor value or None if not found
        """
        try:
            if 'descriptors' in component_data:
                descriptors = component_data['descriptors']
                if (isinstance(descriptors, dict) and
                        descriptor_key in descriptors):
                    return descriptors[descriptor_key]
                else:
                    self._addWarning(
                        f'Descriptor key "{descriptor_key}" not found in '
                        'descriptors')
                    return None
            else:
                self._addWarning('No descriptors found in component_data')
                return None
        except Exception as e:
            self._addError(f'Error extracting descriptor: {str(e)}')
            return None

    def convert_descriptor_to_gh_data(self, descriptor_value):
        """
        Convert descriptor value to appropriate Grasshopper data structure.

        Args:
            descriptor_value: The descriptor value (always float values)

        Returns:
            Grasshopper DataTree with appropriate structure
        """
        result_tree = Grasshopper.DataTree[System.Object]()

        if descriptor_value is None:
            return result_tree

        # Single float value
        if isinstance(descriptor_value, (int, float)):
            ghp = Grasshopper.Kernel.Data.GH_Path(0)
            result_tree.Add(float(descriptor_value), ghp)

        # List of floats
        elif isinstance(descriptor_value, list):
            if len(descriptor_value) == 0:
                return result_tree

            # Check if it's a list of lists (2D)
            if all(isinstance(item, list) for item in descriptor_value):
                # Check if it's 3D (list of lists of lists)
                is_3d = all(isinstance(sublist_item, list)
                            for sublist in descriptor_value
                            for sublist_item in sublist)
                if is_3d:
                    # 3D structure: [[[1,2],[3,4]], [[5,6],[7,8]]]
                    # Paths: (0;0), (0;1), (1;0), (1;1)
                    for i, sublist in enumerate(descriptor_value):
                        for j, inner_list in enumerate(sublist):
                            ghp = Grasshopper.Kernel.Data.GH_Path(i, j)
                            for value in inner_list:
                                result_tree.Add(float(value), ghp)
                else:
                    # 2D structure: [[1,2,3], [9,8,7]]
                    # Paths: (0) for first sublist, (1) for second sublist
                    for i, sublist in enumerate(descriptor_value):
                        ghp = Grasshopper.Kernel.Data.GH_Path(i)
                        for value in sublist:
                            result_tree.Add(float(value), ghp)
            else:
                # Simple list of floats: [1,2,3]
                # Single branch: (0)
                path = Grasshopper.Kernel.Data.GH_Path(0)
                for value in descriptor_value:
                    result_tree.Add(float(value), path)
        else:
            # Fallback for other types
            ghp = Grasshopper.Kernel.Data.GH_Path(0)
            result_tree.Add(float(descriptor_value), ghp)

        return result_tree

    def RunScript(self,
            Input: System.Collections.Generic.List[object],
            DescriptorKey: str):
        # set up output trees and results tuple
        DescriptorValues = Grasshopper.DataTree[System.Object]()
        try:
            # Validate inputs
            if not Input:
                msg = 'No input provided'
                self._addWarning(msg)
                self.Component.Message = msg
                return DescriptorValues

            if not DescriptorKey:
                msg = 'No descriptor key provided'
                self._addWarning(msg)
                self.Component.Message = msg
                return DescriptorValues

            self.Component.Message = 'Processing inputs...'

            # Process each input item
            input_list = list(Input)
            for input_index, input_item in enumerate(input_list):
                # Determine input type and extract component data
                component_data = None

                # Check if input is a JSON string (ComponentData)
                if isinstance(input_item, str):
                    try:
                        component_data = json.loads(input_item)
                        self._addRemark(
                            f'Input {input_index} detected as ComponentData '
                            'JSON')
                    except json.JSONDecodeError:
                        msg = (f'Input {input_index} is not valid JSON '
                               'ComponentData!')
                        self._addError(msg)
                        continue
                else:
                    # Input is geometry - extract component data from userdata
                    component_data = self.extract_component_data_from_geometry(
                        input_item)
                    if not component_data:
                        msg = (f'Could not extract component data from '
                               f'input {input_index}!')
                        self._addError(msg)
                        continue

                    self._addRemark(
                        f'Input {input_index} detected as geometry with '
                        'component userdata')

                # Extract descriptor value
                try:
                    descriptor_value = self.get_descriptor_value(
                        component_data, DescriptorKey)

                    if descriptor_value is not None:
                        # Convert descriptor to appropriate Grasshopper data
                        converted_tree = self.convert_descriptor_to_gh_data(
                            descriptor_value)

                        # Merge the converted tree into the output
                        for i in range(converted_tree.BranchCount):
                            original_path = converted_tree.Path(i)
                            # get runcount for first GH Tree index
                            rc = self.Component.RunCount - 1
                            # Prepend input index to the path
                            new_path = Grasshopper.Kernel.Data.GH_Path(
                                0,
                                rc,
                                input_index,
                                *original_path.Indices)
                            branch_data = converted_tree.Branch(i)
                            for item in branch_data:
                                DescriptorValues.Add(item, new_path)

                        self._addRemark(
                            f'Successfully extracted descriptor '
                            f'"{DescriptorKey}" from input {input_index}'
                        )
                    else:
                        # Descriptor not found
                        msg = (f'Descriptor "{DescriptorKey}" not found in '
                               f'input {input_index}')
                        self._addWarning(msg)

                except Exception as e:
                    msg = (f'Error extracting descriptor from input '
                           f'{input_index}: {str(e)}')
                    self._addError(msg)

            # Update success message
            self.Component.Message = f'Processed {len(input_list)} input(s)'

            # return output trees
            return DescriptorValues

        except Exception as e:
            msg = f'Unexpected error during descriptor extraction: {str(e)}'
            self._addError(msg)
            return DescriptorValues
# ---------- end getdescriptor ----------
radial_distance_64 = Data(getdescriptor)

# Step 3.2
# comments & notes: Get radial shape signature tangent vectors with medium (32 rays) resolution.
panel_3 = Panel("radial_tangent_64")
componentdata_4 = Data(componentdata)
getdescriptor_2 = GetDescriptor(Input=componentdata_4, DescriptorKey=panel_3)  # -> DescriptorValues; inputs Input: list, DescriptorKey: String; same code as getdescriptor
radial_tangent_64 = Data(getdescriptor_2)

# Step 4.1
# comments & notes: We also combine the values from the server-side-computed radial signature of the components in the catalog.
# 
# The data arrives in grasshopper slightly differently. This has technical reasons and explaining them here would be a bit much ;-)
# 
# Again, what matters: 192 numeric values per shape that are able to describe the form. In the same format and order (!) as the 192 numeric values for our design shapes.
radial_distance_64_2 = Data(radial_distance_64)
radial_tangent_64_2 = Data(radial_tangent_64)
item = ListItem(List=radial_tangent_64_2, Index=0, Wrap=True)  # -> Item, Item1
pshift = ShiftPaths(Data=item.Item1, Offset=-1)
pshift_2 = ShiftPaths(Data=item.Item, Offset=-1)
panel_4 = Panel("""0
1
2""")
weave = Weave(Pattern=panel_4, Stream0=radial_distance_64_2, Stream1=pshift_2, Stream2=pshift, NullGaps=False)
pshift_3 = ShiftPaths(Data=weave, Offset=-2)
catalogshapes_radialsignature = Data(pshift_3)

# Step 4.1
# comments & notes: Here we combine the values of the radial signature. This is a rather data-structure-centric operation.
# 
# You don't necessarily need to understand it fully. What matters is our result - in this case:
# 
# 192 numeric values per shape that are able to describe the form.
designshapes_distances_2 = Data(designshapes_distances)
designshapes_tangents_2 = Data(designshapes_tangents)
devec = DeconstructVector(Vector=designshapes_tangents_2)  # -> XComponent, YComponent, ZComponent
panel_5 = Panel("""0
1
2""")
weave_2 = Weave(Pattern=panel_5, Stream0=designshapes_distances_2, Stream1=devec.XComponent, Stream2=devec.YComponent, NullGaps=False)
designshapes_radialsignature = Data(weave_2)

# Step 3.4
# comments & notes: Extract Extrusion Profile curves.
primitivegeometry_2 = Data(primitivegeometry)
extrusionprofile = ExtrusionProfile(ExtrusionGeometry=primitivegeometry_2)  # -> ProfileCurve; inputs ExtrusionGeometry: Extrusion, ProfileIndex: Int32, ProfileParameter: Double
# ---------- extrusionprofile: Python ----------
#! python3
# -*- coding: utf-8 -*-
# venv: DDU_CSC
print('ENV OK!')
# r: charset_normalizer
# r: requests
# r: numpy
# r: scipy
# r: scikit-learn
# r: robust-laplacian
# r: potpourri3d

# PYTHON STANDARD LIBRARY IMPORTS ---------------------------------------------

# RHINO AND GH RELATED IMPORTS ------------------------------------------------
import System  # type: ignore[reportMissingImport] # NOQA
import Grasshopper  # type: ignore[reportMissingImport] # NOQA
import Rhino  # type: ignore[reportMissingImport] # NOQA
import scriptcontext as sc  # type: ignore[reportMissingImport] # NOQA

# GHENV COMPONENT SETTINGS ----------------------------------------------------
ghenv.Component.Name = 'ExtrusionProfile'  # type: ignore[reportUnedfinedVariable] # NOQA
ghenv.Component.NickName = 'ExtrusionProfile'  # type: ignore[reportUnedfinedVariable] # NOQA
ghenv.Component.Category = 'DDU_CSC'  # type: ignore[reportUnedfinedVariable] # NOQA
ghenv.Component.SubCategory = '7 Geometry Tools'  # type: ignore[reportUnedfinedVariable] # NOQA
ghenv.Component.Description = (  # type: ignore[reportUnedfinedVariable] # NOQA
    'Extract the profile curves of an Extrusion.'
)


class CSC_ExtrusionProfile(Grasshopper.Kernel.GH_ScriptInstance):
    """
    Author: Max Benjamin Eschenbach
    License: MIT License
    Version: 260423
    """

    def __init__(self):
        """Initialize this component and set component parameters."""
        super().__init__()
        # initialize props
        self.Component = ghenv.Component  # type: ignore[reportUnedfinedVariable] # NOQA
        self.InputParams = self.Component.Params.Input
        self.OutputParams = self.Component.Params.Output

    def _addRemark(self, msg: str = ''):
        """Add a remark message to the component."""
        rml = self.Component.RuntimeMessageLevel.Remark
        self.AddRuntimeMessage(rml, msg)

    def _addWarning(self, msg: str = ''):
        """Add a warning message to the component."""
        rml = self.Component.RuntimeMessageLevel.Warning
        self.AddRuntimeMessage(rml, msg)

    def _addError(self, msg: str = ''):
        """Add an error message to the component."""
        rml = self.Component.RuntimeMessageLevel.Error
        self.AddRuntimeMessage(rml, msg)
    
    def BeforeRunScript(self):
        """Perform some setup actions."""
        # Initialize input param descriptions
        self.InputParams[0].Description = (
            'A Rhino.Geometry.Extrusion to extract '
            'the profile curve from'
        )
        self.InputParams[1].Description = (
            'Index of the profile curve to extract. '
            'The outer profile has index 0.'
        )
        self.InputParams[2].Description = (
            'A relative parameter controlling which profile is returned. '
            '0 = bottom profile and 1 = top profile.'
        )
        # Initialize output param descriptions
        i = 0
        if self.OutputParams[0].Name == 'out':
            i += 1
        self.OutputParams[0+i].Description = (
            'The extracted profile curve.'
        )

    def RunScript(self,
            ExtrusionGeometry: Rhino.Geometry.Extrusion,
            ProfileIndex: int,
            ProfileParameter: float):
        # init outputs
        ProfileCurve = Grasshopper.DataTree[System.Object]()
        # defaults
        if not ExtrusionGeometry:
            self._addWarning('Input Parameter ExtrusionGeometry failed to colect data.')
            self.Component.Message = (
                f'No Profile extracted.')
            return ProfileCurve
        if ProfileIndex is None:
            ProfileIndex = 0
        elif ProfileIndex < ExtrusionGeometry.ProfileCount - 1:
            self._addError('Input Parameter ProfileIndex is out of range!')
            return ProfileCurve
        elif ProfileIndex > ExtrusionGeometry.ProfileCount - 1:
            self._addError('Input Parameter ProfileIndex is out of range!')
            return ProfileCurve
        if ProfileParameter is None:
            ProfileParameter = 0.5
        elif ProfileParameter < 0:
            self._addWarning('ProfileParameter was set to 0.0! Must be >= 0.0 and <= 1.0!')
            ProfileParameter = 0.0
        elif ProfileParameter > 1:
            self._addWarning('ProfileParameter was set to 1.0! Must be >= 0.0 and <= 1.0!')
            ProfileParameter = 0.0
        # finally extract profile curve
        ProfileCurve = ExtrusionGeometry.Profile3d(0, 0.5)
        self.Component.Message = (
            f'Extrusion Profile at i = {ProfileIndex} | s = {ProfileParameter}')
        # return results
        return ProfileCurve
# ---------- end extrusionprofile ----------
profilecurve = Data(extrusionprofile)

# Step 5
# comments & notes: Here we use an assignment algorithm to find the most fitting parts from our catalog (CatalogShapes) for our DesignShapes.
# 
# This algorithm works with the 192 numeric values we have acquired in the last steps.
# 
# There is a Greedy (fast) option and the famous Hungarian (optimal) version.
catalogshapes_radialsignature_2 = Data(catalogshapes_radialsignature)
designshapes_radialsignature_2 = Data(designshapes_radialsignature)
algorithm = ValueList({"Greedy": "greedy", "Hungarian": "hungarian"}, selected="Greedy")
assignmentpoints = AssignmentPoints(DesignPts=designshapes_radialsignature_2, LibraryPts=catalogshapes_radialsignature_2, Algorithm=algorithm)  # -> Assignment, Cost; inputs DesignPts: tree of Double, LibraryPts: tree of Double, Weights: list of Double, ScaleFactor: Double, Algorithm: String
# ---------- assignmentpoints: Python ----------
#! python3
# -*- coding: utf-8 -*-
# venv: DDU_CSC
print('ENV OK!')
# r: charset_normalizer
# r: requests
# r: numpy
# r: scipy
# r: scikit-learn
# r: robust-laplacian
# r: potpourri3d

# THIRD PARTY LIBRARY IMPORTS -------------------------------------------------
import numpy as np  # NOQA
from scipy.optimize import linear_sum_assignment  # NOQA

# RHINO AND GH RELATED IMPORTS ------------------------------------------------
import System  # NOQA
import Grasshopper  # NOQA
import Rhino  # NOQA

# GHENV COMPONENT SETTINGS ----------------------------------------------------
ghenv.Component.Name = 'AssignmentPoints'  # NOQA
ghenv.Component.NickName = 'AssignmentPoints'  # NOQA
ghenv.Component.Category = 'DDU_CSC'  # NOQA
ghenv.Component.SubCategory = '5 Matchmaking Tools'  # NOQA
ghenv.Component.Description = (  # NOQA
    'Solve point-to-point assignment between DesignPts and LibraryPts. '
    'Supports Greedy assignment (default, FullCircle-compatible) and '
    'Hungarian assignment (SciPy).'
)

def _weighted_euclidean_distance(pt1, pt2, weights):
    p1 = np.asarray(pt1, dtype=np.float64)
    p2 = np.asarray(pt2, dtype=np.float64)
    w = np.asarray(weights, dtype=np.float64)
    return float(np.sqrt(np.sum(w * np.square(p2 - p1))))


class CSC_AssignmentPoints(Grasshopper.Kernel.GH_ScriptInstance):
    """
    Author: Max Benjamin Eschenbach
    License: MIT License
    Version: 260423
    """

    def __init__(self):
        super().__init__()
        self.Component = ghenv.Component  # NOQA
        self.InputParams = self.Component.Params.Input
        self.OutputParams = self.Component.Params.Output

    def _addRemark(self, msg=''):
        self.AddRuntimeMessage(self.Component.RuntimeMessageLevel.Remark, msg)

    def _addWarning(self, msg=''):
        self.AddRuntimeMessage(self.Component.RuntimeMessageLevel.Warning, msg)

    def _addError(self, msg=''):
        self.AddRuntimeMessage(self.Component.RuntimeMessageLevel.Error, msg)

    def BeforeRunScript(self):
        self.InputParams[0].Description = (
            'Design points as DataTree of Numbers. Each branch is one point.'
        )
        self.InputParams[1].Description = (
            'Library points as DataTree of Numbers. Each branch is one point.'
        )
        self.InputParams[2].Description = (
            'Weights for weighted Euclidean distance. Optional; defaults to '
            '1.0 in each dimension.'
        )
        self.InputParams[3].Description = (
            'Scale factor used by Hungarian mode before optimization. '
            'Optional; default 1e3. Ignored by Greedy mode.'
        )
        self.InputParams[4].Description = (
            "Algorithm selector. Optional; defaults to 'greedy'. "
            "Accepted values: 'greedy', 'hungarian'."
        )

        i = 1 if self.OutputParams[0].Name == 'out' else 0
        self.OutputParams[0 + i].Description = (
            'Assignment tree. Branch i contains selected library index for '
            'design point i.'
        )
        self.OutputParams[1 + i].Description = (
            'Assignment cost tree. Branch i contains the cost value for '
            'design point i.'
        )

    def _collect_tree_branches(self, tree):
        if tree is None or tree.DataCount == 0:
            return []
        return [list(tree.Branch(path)) for path in tree.Paths]

    def _normalize_algorithm(self, algorithm):
        if algorithm is None:
            return 'greedy'
        alg = str(algorithm).strip().lower()
        if alg in ('', 'greedy', 'g'):
            return 'greedy'
        if alg in ('hungarian', 'hungary', 'h', 'scipy'):
            return 'hungarian'
        return None

    def _build_cost_matrices(self, design_branches, library_branches, weights):
        n = len(design_branches)
        m = len(library_branches)
        costs = np.zeros((m, m), dtype=np.float64)
        for i in range(m):
            if i >= n:
                continue
            for j in range(m):
                costs[i, j] = _weighted_euclidean_distance(
                    design_branches[i], library_branches[j], weights
                )
        return costs

    def _run_greedy(self, costs):
        m = int(costs.shape[0])
        selected = np.zeros(m, dtype=np.int32)
        assignment = np.full(m, -1, dtype=np.int32)

        for i in range(m):
            min_cost = float('inf')
            sel = -1
            for j in range(m):
                c = float(costs[i, j])
                if c < min_cost and selected[j] == 0:
                    min_cost = c
                    sel = j
            if sel < 0:
                raise ValueError('Greedy assignment failed to select a column')
            selected[sel] = 1
            assignment[i] = sel
        return assignment

    def _run_hungarian(self, costs, scale_factor):
        scaled = np.asarray(
            np.floor(costs * float(scale_factor)),
            dtype=np.int64,
        )
        rows, cols = linear_sum_assignment(scaled)
        assignment = np.full(scaled.shape[0], -1, dtype=np.int32)
        assignment[rows] = cols.astype(np.int32)
        if np.any(assignment < 0):
            raise ValueError('Hungarian assignment did not cover all rows')
        return assignment

    def RunScript(self,
            DesignPts: Grasshopper.DataTree[float],
            LibraryPts: Grasshopper.DataTree[float],
            Weights: System.Collections.Generic.List[float],
            ScaleFactor: float,
            Algorithm: str):
        Assignment = Grasshopper.DataTree[System.Object]()
        Cost = Grasshopper.DataTree[System.Object]()
        __Results = (Assignment, Cost)

        self.Component.Message = None

        design_branches = self._collect_tree_branches(DesignPts)
        library_branches = self._collect_tree_branches(LibraryPts)
        n = len(design_branches)
        m = len(library_branches)

        if n == 0:
            self._addWarning('DesignPts failed to collect data!')
            self.Component.Message = 'no design data'
            return __Results
        if m == 0:
            self._addWarning('LibraryPts failed to collect data!')
            self.Component.Message = 'no library data'
            return __Results
        if n > m:
            self._addError(
                'Number of DesignPts needs to be smaller than number of '
                'LibraryPts!'
            )
            return __Results

        dim = len(design_branches[0])
        if dim == 0:
            self._addError('DesignPts branches are empty')
            return __Results

        for i, b in enumerate(design_branches):
            if len(b) != dim:
                self._addError(
                    f'DesignPts branch #{i} has dimension {len(b)}; '
                    f'expected {dim}.'
                )
                return __Results
        for j, b in enumerate(library_branches):
            if len(b) != dim:
                self._addError(
                    f'LibraryPts branch #{j} has dimension {len(b)}; '
                    f'expected {dim}.'
                )
                return __Results

        if not Weights or len(Weights) == 0:
            weights = np.ones(dim, dtype=np.float64)
        else:
            if len(Weights) != dim:
                self._addError(
                    f'Weights length ({len(Weights)}) does not match point '
                    f'dimension ({dim}).'
                )
                return __Results
            weights = np.asarray([float(w) for w in Weights], dtype=np.float64)

        algorithm = self._normalize_algorithm(Algorithm)
        if algorithm is None:
            self._addError(
                "Invalid Algorithm value. Use 'greedy' or 'hungarian'."
            )
            return __Results

        if ScaleFactor is None:
            ScaleFactor = 1e3
        try:
            scale_factor = float(ScaleFactor)
        except (TypeError, ValueError):
            self._addError(f'ScaleFactor must be numeric, got {ScaleFactor!r}')
            return __Results
        if not np.isfinite(scale_factor) or scale_factor <= 0.0:
            self._addError(f'ScaleFactor must be > 0, got {scale_factor}')
            return __Results

        try:
            real_costs = self._build_cost_matrices(
                design_branches, library_branches, weights
            )
            if algorithm == 'hungarian':
                assignment = self._run_hungarian(real_costs, scale_factor)
                self.Component.Message = 'Hungarian Algorithm'
            else:
                assignment = self._run_greedy(real_costs)
                self.Component.Message = 'Greedy Algorithm'
        except Exception as exc:
            self._addError(f'Assignment failed: {exc}')
            return __Results

        for i in range(n):
            path = Grasshopper.Kernel.Data.GH_Path(i)
            j = int(assignment[i])
            Assignment.Add(j, path)
            Cost.Add(float(real_costs[i, j]), path)

        self._addRemark(
            f'Assigned {n} design points to {m} library points using '
            f'{algorithm}.'
        )
        return __Results
# ---------- end assignmentpoints ----------
assignment = Data(assignmentpoints.Assignment)
panel_6 = Panel(assignment)

# Step 6
# comments & notes: Finally, we use the assignment indices to get the assigned data tree branches from the catalog.
# 
# Then we use the inverse of our DesignShapes RestPosition transformation to transform the catalog shapes into the "best" orientation for the respective Design Shapes.
catalogshapes_profilecurves = Data(profilecurve)
assignment_2 = Data(assignment)
id_2 = Data(id)
tstat = TreeStatistics(Tree=catalogshapes_profilecurves)  # -> Paths, Length, Count
designshapes_restpositiontransform_2 = Data(designshapes_restpositiontransform)
tstat_2 = TreeStatistics(Tree=id_2)  # -> Paths, Length, Count
item_2 = ListItem(List=tstat.Paths, Index=assignment_2, Wrap=True)
item_3 = ListItem(List=tstat_2.Paths, Index=assignment_2, Wrap=True)
inverse = InverseTransform(Transform=designshapes_restpositiontransform_2)
branch = TreeBranch(Tree=catalogshapes_profilecurves, Path=item_2, MaintainPaths=True)
branch_2 = TreeBranch(Tree=id_2, Path=item_3, MaintainPaths=True)
ids_of_assigned_components = Panel(branch_2)
transform = Transform(Geometry=branch, Transform=inverse)
catalogshapes_atdesignshapelocation = Data(transform)
curvepreviewlw_2 = CurvePreviewLW(Curves=flatten(transform), Colors=ColourSwatch(SwatchColor=RGB(242, 0, 255)), Thickness=Slider(2, range=0..10))  # inputs Curves: list of Curve, Colors: list of Color, Thickness: list of Int32; same code as curvepreviewlw
